# Grasshopper definition animation_piton.ghx (Grasshopper 1.0.7)
# plug-ins: Human

# ---- group: Application Control
reset = BooleanToggle(True)
python = GhPythonScript(reset=reset)  # -> reset; inputs reset: Boolean
# ---------- python: Python ----------
from ghpythonlib.componentbase import executingcomponent as component
import Grasshopper, GhPython
import System
import Rhino
import rhinoscriptsyntax as rs
import scriptcontext as sc
import time

class MyComponent(component):
    
    def RunScript(self, reset):
        """Provides a scripting component.
            Inputs:
                x: The x script variable
                y: The y script variable
            Output:
                a: The a output variable"""
        
        __author__ = "remote"
        __version__ = "2020.08.05"
        if reset:
            sc.sticky["AgentActivationDone"] = False
        
        import rhinoscriptsyntax as rs
        print sc.sticky["AgentActivationDone"]
        print reset
        sc.sticky["StartFrame"] = int(time.time()*1000)
        # return outputs if you have them; here I try it for you:
        return (reset or not sc.sticky["AgentActivationDone"])
# ---------- end python ----------
checkagent = BooleanToggle(False)

# ----
timer = Timer(TimerInterval=10, Target=python)
relay = Relay()
timer_2 = Timer(TimerInterval=20)  # disabled

# ---- group: Initial Param
python_2 = GhPythonScript()  # -> initial_location
# ---------- python_2: Python ----------
from ghpythonlib.componentbase import executingcomponent as component
import Grasshopper, GhPython
import System
import Rhino as rh
import rhinoscriptsyntax as rs
from Rhino.Geometry import Point3d

class MyComponent(component):
    def __init__(self):
        self.m_startPoint = []
    
    def RunScript(self, ):
        """Provides a scripting component.
            Inputs:
                x: The x script variable
                y: The y script variable
            Output:
                a: The a output variable"""
        
        __author__ = "remote"
        __version__ = "2020.09.29"
        
        import rhinoscriptsyntax as rs
        if len(self.m_startPoint) == 0:
            obj = rh.RhinoDoc.ActiveDoc.Objects.FindByLayer("START_POINT")
            self.m_startPoint = [None] * len(obj)
            for o in obj:
                #print o.GetType()
                #print rh.DocObjects.PointObject.PointGeometry.GetValue()
                #print o.PointGeometry.Location.GetType()
                index = int(rs.GetUserText(o,"StartPoint"))
                self.m_startPoint[index] = o
            #Rhino.Geometry.Point.
        # return outputs if you have them; here I try it for you:
        return self.m_startPoint
# ---------- end python_2 ----------
python_3 = GhPythonScript()  # -> area, mapName
# ---------- python_3: Python ----------
from ghpythonlib.componentbase import executingcomponent as component
import Grasshopper, GhPython
import System
import Rhino as rh
import rhinoscriptsyntax as rs
from Rhino.Geometry import Rectangle3d

class MyComponent(component):
    def __init__(self):
        self.m_area = []
    
    def RunScript(self, ):
        """Provides a scripting component.
            Inputs:
                x: The x script variable
                y: The y script variable
            Output:
                a: The a output variable"""
        
        __author__ = "remote"
        __version__ = "2020.09.29"
        
        import rhinoscriptsyntax as rs
        if len(self.m_area) == 0:
            obj = rh.RhinoDoc.ActiveDoc.Objects.FindByLayer("AREA_LIMIT")
            self.m_area = [None] * len(obj)
            mapName = ""
            print(len(obj))
            for ob in obj:
                pl = ob.Geometry.ToPolyline()
                rect = Rectangle3d(rh.Geometry.Plane.WorldXY,pl[0],pl[2])
                floor = int(rs.GetUserText(ob,"AreaLimit"))
                self.m_area[floor] = rect
                mapName = rs.GetUserText(ob,"MapName")
        # return outputs if you have them; here I try it for you:
        print(mapName)
        return self.m_area,mapName
# ---------- end python_3 ----------
initial_state = Integer([0, 0, 0])

# ---- group: Loop Control
c_script = CSharpScript(reset=python)  # -> out, deltaTime, state; inputs reset: Boolean
# ---------- c_script: C# usings ----------
using System.IO;
using System.Linq;
using System.Data;
using System.Drawing;
using System.Reflection;
using System.Windows.Forms;
using System.Xml;
using System.Xml.Linq;
using System.Runtime.InteropServices;

using Rhino.DocObjects;
using Rhino.Collections;
using GH_IO;
using GH_IO.Serialization;
# ---------- c_script: C# ----------
    if(!reset){
      c++;
    }else{
      c = -1;
    }
    c = (int) (c % (201));


    deltaTime = c;
    if(!reset)
    {
      state = 1;
    }
    else
    {
      state = 0;
    }
    if(oldTime == DateTime.MinValue)
    {
      deltaTime = 0;
    }
    else
    {
      deltaTime = (DateTime.Now - oldTime).TotalMilliseconds;
    }
    oldTime = DateTime.Now;
# ---------- c_script: C# additional code ----------
  int c = -1;
  DateTime oldTime = DateTime.MinValue;
# ---------- end c_script ----------

# ----
python_4 = GhPythonScript(Locations=python_2, Reset=reset, Frame=c_script.deltaTime, mapName=python_3.mapName)  # -> ActiveAgent, retSurface, retImg; inputs Locations: list, Reset: Boolean
# ---------- python_4: Python ----------
from ghpythonlib.componentbase import executingcomponent as component
import Grasshopper, GhPython
import System
import Rhino
import rhinoscriptsyntax as rs
import sys
from Rhino.Geometry import NurbsSurface, Point3d
import scriptcontext as sc

import Rhino.UI
import Eto.Drawing as drawing
import Eto.Forms as forms

class AgentActivator(forms.Form):
    def __init__(self):
        cFPath = ghenv.Component.OnPingDocument().FilePath
        cpath = cFPath[0:cFPath.rfind('\\')+1]
        self.m_imgPath = []
        self.m_imgPath.append(cpath+'..\\res\\m5.png')
        self.m_imgPath.append(cpath+'..\\res\\w3.png')
        self.m_imgPath.append(cpath+'..\\res\\m2.png')
        self.m_imgPath.append(cpath+'..\\res\\w1.png')
        self.m_imgPath.append(cpath+'..\\res\\m4.png')
        self.m_imgPath.append(cpath+'..\\res\\w2.png')
        self.m_imgPath.append(cpath+'..\\res\\m6.png')
        self.m_imgPath.append(cpath+'..\\res\\w4.png')
        
        self.m_names = []
        self.m_names.append("Pak Rudi")
        self.m_names.append("Bu Rudi")
        self.m_names.append("Rian")
        self.m_names.append("Sita")
        self.m_names.append("Kek Ramli")
        self.m_names.append("Nek Ramli")
        self.m_names.append("Dede")
        self.m_names.append("Linda")
        
        self.m_ticks = []
        
        self.Title = "Choosa Active Agent"
        self.Padding = drawing.Padding(10)
        
        self.m_layout = forms.DynamicLayout()
        self.m_layout.Spacing = drawing.Size(5,5)
        self.m_layout.Padding = drawing.Padding(10)
        
        layoutDay = forms.DynamicLayout()
        layoutDay.Spacing = drawing.Size(5,5)
        layoutDay.Padding = drawing.Padding(10)
        
        self.m_numberDayDropDown = forms.DropDown()
        for i in range(1,31):
            self.m_numberDayDropDown.Items.Add(str(i))
        self.m_numberDayDropDown.SelectedIndex = 0
        layoutDay.AddRow(forms.Label(Text = "Days"), self.m_numberDayDropDown)
        
        layoutSpeed = forms.DynamicLayout()
        layoutSpeed.Spacing = drawing.Size(5,5)
        layoutSpeed.Padding = drawing.Padding(10)
        
        self.m_ScaleSpeedDropDown = forms.DropDown()
        for i in range(1,4):
            self.m_ScaleSpeedDropDown.Items.Add(str(i)+"x")
        self.m_ScaleSpeedDropDown.SelectedIndex = 0
        layoutSpeed.AddRow(forms.Label(Text = "Speed"), self.m_ScaleSpeedDropDown)
        self.m_layout.AddRow(layoutSpeed,layoutDay)
        
        for i in range(0,4):
            layout = forms.DynamicLayout()
            tick = forms.CheckBox()
            self.m_ticks.append(tick)
            personIcon = forms.ImageView()
            personIcon.Size = drawing.Size(50,50)
            personIcon.Image = drawing.Bitmap(self.m_imgPath[i*2])
            name = forms.Label(Text = self.m_names[i*2],HorizontalAlign = forms.HorizontalAlign.Center)
            layout.Spacing = drawing.Size(5,5)
            layout.Padding = drawing.Padding(10)
            layout.AddRow(tick,personIcon)
            layout.AddRow(None,name)
            
            layout2 = forms.DynamicLayout()
            tick = forms.CheckBox()
            self.m_ticks.append(tick)
            personIcon = forms.ImageView()
            personIcon.Size = drawing.Size(50,50)
            personIcon.Image = drawing.Bitmap(self.m_imgPath[(i*2)+1])
            name = forms.Label(Text = self.m_names[(i*2)+1],HorizontalAlign = forms.HorizontalAlign.Center)
            layout2.Spacing = drawing.Size(5,5)
            layout2.Padding = drawing.Padding(10)
            layout2.AddRow(tick,personIcon)
            layout2.AddRow(None,name)
            
            self.m_layout.AddRow(layout,layout2)
        self.DefaultButton = forms.Button(Text = 'OK')
        self.DefaultButton.Click += self.OnOKButtonClick
        self.m_layout.AddRow(self.DefaultButton)
        self.m_layout.AddSpace()
        self.m_shown = False
        self.Shown += self.Osho
        self.Closed += self.Oclo
        self.Content = self.m_layout
        
    def OnOKButtonClick(self, sender, e):
        self.Close()
    
    def Osho(self, sender, e):
        self.m_shown = True
        
    def Oclo (self, sender, e):
        self.m_shown = False
        sc.sticky["AgentActivationDone"] = True
        sc.sticky["NumberOfDays"] = self.m_numberDayDropDown.SelectedIndex + 1
        sc.sticky["SimulationSpeed"] = self.m_ScaleSpeedDropDown.SelectedIndex + 1
        
    def AdjustAgentCount(self, amount):
        curShow = 0
        self.m_layout = forms.DynamicLayout()
        self.m_layout.Spacing = drawing.Size(5,5)
        self.m_layout.Padding = drawing.Padding(10)
        self.m_ticks = []
        
        layoutDay = forms.DynamicLayout()
        layoutDay.Spacing = drawing.Size(5,5)
        layoutDay.Padding = drawing.Padding(10)
        
        self.m_numberDayDropDown = forms.DropDown()
        for i in range(1,31):
            self.m_numberDayDropDown.Items.Add(str(i))
        self.m_numberDayDropDown.SelectedIndex = 0
        
        layoutDay.AddRow(forms.Label(Text = "Days"), self.m_numberDayDropDown)
        
        layoutSpeed = forms.DynamicLayout()
        layoutSpeed.Spacing = drawing.Size(5,5)
        layoutSpeed.Padding = drawing.Padding(10)
        
        self.m_ScaleSpeedDropDown = forms.DropDown()
        for i in range(1,4):
            self.m_ScaleSpeedDropDown.Items.Add(str(i)+"x")
        self.m_ScaleSpeedDropDown.SelectedIndex = 0
        layoutSpeed.AddRow(forms.Label(Text = "Speed"), self.m_ScaleSpeedDropDown)
        self.m_layout.AddRow(layoutSpeed,layoutDay)
        
        for i in range(0,4):
            layout = None
            layout2 = None
            if curShow < amount:
                layout = forms.DynamicLayout()
                tick = forms.CheckBox()
                self.m_ticks.append(tick)
                personIcon = forms.ImageView()
                personIcon.Size = drawing.Size(50,50)
                personIcon.Image = drawing.Bitmap(self.m_imgPath[i*2])
                name = forms.Label(Text = self.m_names[i*2],HorizontalAlign = forms.HorizontalAlign.Center)
                layout.Spacing = drawing.Size(5,5)
                layout.Padding = drawing.Padding(10)
                layout.AddRow(tick,personIcon)
                layout.AddRow(None,name)
            
            curShow+=1
            if curShow < amount:            
                layout2 = forms.DynamicLayout()
                tick = forms.CheckBox()
                self.m_ticks.append(tick)
                personIcon = forms.ImageView()
                personIcon.Size = drawing.Size(50,50)
                personIcon.Image = drawing.Bitmap(self.m_imgPath[(i*2)+1])
                name = forms.Label(Text = self.m_names[(i*2)+1],HorizontalAlign = forms.HorizontalAlign.Center)
                layout2.Spacing = drawing.Size(5,5)
                layout2.Padding = drawing.Padding(10)
                layout2.AddRow(tick,personIcon)
                layout2.AddRow(None,name)
            curShow+=1
            self.m_layout.AddRow(layout,layout2)
        self.m_layout.AddRow(self.DefaultButton)
        self.m_layout.AddSpace()
        self.Content = self.m_layout
        print "ketik "+str(len(self.m_ticks))

class MyComponent(component):
    def __init__(self):
        self.m_activeAgent = [False for i in range(0,8)]
        self.m_hasSetup = False
        self.m_klow = False
        self.m_dialoh = AgentActivator()
        self.m_count = 0
        self.m_surfaces = []
        
    def RunScript(self, Locations, Reset, Frame, MapName):
        UsedLocation = None
        sc.sticky["MapName"] = MapName
        """Provides a scripting component.
            Inputs:
                x: The x script variable
                y: The y script variable
            Output:
                a: The a output variable"""
        
        __author__ = "remote"
        __version__ = "2020.07.27"
        if len(self.m_activeAgent) != len(Locations):
            self.m_hasSetup = False
        import rhinoscriptsyntax as rs
        print "omake "+str(Reset)+" "+str(self.m_hasSetup)
        if  (not Reset) and (not self.m_hasSetup):# and (not self.m_klow) :
            self.m_dialoh = AgentActivator()
            self.m_dialoh.m_names = []
            for loc in Locations:
                role = rs.GetUserText(loc,"Role")
                self.m_dialoh.m_names.append(role)
            for rul in self.m_dialoh.m_names:
                print rul
            self.m_dialoh.AdjustAgentCount(len(Locations))
            self.m_activeAgent = [False for i in range(0,len(Locations))]
            print "ajusting "+str(len(Locations))
            self.m_dialoh.Show()#Rhino.UI.RhinoEtoApp.MainWindow)
            self.m_hasSetup = True
            self.m_klow = True
            halfSize = 0.2
            print "ketot "+str(len(self.m_dialoh.m_ticks))
            for pLoc in Locations:
                if pLoc != None:
                    loc = pLoc.PointGeometry.Location
                    surface = NurbsSurface.CreateFromCorners(Point3d(loc.X - halfSize,loc.Y-halfSize,0),Point3d(loc.X+halfSize,loc.Y-halfSize,0),Point3d(loc.X+halfSize,loc.Y+halfSize,0),Point3d(loc.X - halfSize,loc.Y+halfSize,0))
                    self.m_surfaces.append(surface)
        elif Reset:
            print "respati"
            self.m_hasSetup = False
            self.m_count += 1
            if self.m_klow:
                self.m_dialoh.Close()
                self.m_klow
        #print self.m_dialoh.m_shown
        #print self.m_count
        #print self.m_activeAgent
        # return outputs if you have them; here I try it for you:
        retSurface = []
        retImg = []
        self.m_activeAgent = [tick.Checked for tick in self.m_dialoh.m_ticks]
        if self.m_dialoh.m_shown:
            print len(self.m_activeAgent)
            for i,isActive in enumerate(self.m_activeAgent):
                if isActive:
                    retSurface.append(self.m_surfaces[i])
                    retImg.append(self.m_dialoh.m_imgPath[i])
        
        return self.m_activeAgent,retSurface,retImg
# ---------- end python_4 ----------
previewmat = CustomPreviewMaterials(Geometry=python_4.retSurface, DiffuseColor=RGBA(255, 255, 255, 1), DiffuseBitmap=python_4.retImg)

# ---- group: Initializer
gridgenerator = GhPythonScript(area=python_3.area, reset=python, mapName=python_3.mapName)  # -> gridArea, topPos, additionalWeight, rooms, polina; inputs area: list, counter: Int32, reset: Boolean
# ---------- gridgenerator: Python ----------
from ghpythonlib.componentbase import executingcomponent as component
import Grasshopper, GhPython
import System
import Rhino as rh
import rhinoscriptsyntax as rs
import scriptcontext as sc
import math
import csv
import Rhino.Geometry as rg
import sys

from Rhino.Geometry import Point3d,Point,NurbsSurface

cFPath = ghenv.Component.OnPingDocument().FilePath
cpath = cFPath[0:cFPath.rfind('\\')+1]
my_path = cpath+'..\source'
if not my_path in sys.path:
    sys.path.append(my_path)

import Global
import Target
Target = reload(Target)

import HomeObject
HomeObject = reload(HomeObject)

import Agent
Agent = reload(Agent)

import EntryPoint
EntryPoint = reload(EntryPoint)

import House
House = reload(House)

import Door
Door = reload(Door)
DIRECTION_CCW = -1
DIRECTION_CW = 1
OFFSET = 0.01

import PathFinding
PathFinding = reload(PathFinding)

import CommonEnum
import Timer
import Config
Timer = reload(Timer)

STATE_FREE = 0
STATE_BLOCKED = 1
STATE_ENTRY = 2
STATE_BLOCKED_OBJ = 3


class MyComponent(component):
    
    def __init__(self):
        self.NEIGHBOR_CHECK = []
        self.NEIGHBOR_DIS = 2
        self.WALL_DISTANCE = 0.12
        self.gridSize = 0.08
        self.grids = []
        self.gridInitialized = False
        self.topPos = []
        self.possibleTarget = []
        self.entryPoint = []
        self.isRun = False
        self.additionalWeight = []
        self.m_rooms = []
        self.polina = []
        self.m_doors = []
    
    def GenerateNeighborCheck(self):
        self.NEIGHBOR_CHECK = []
        for i in range(-self.NEIGHBOR_DIS,self.NEIGHBOR_DIS+1):
            for j in range(-self.NEIGHBOR_DIS,self.NEIGHBOR_DIS+1):
                if i == 0 and j == 0:
                    continue
                self.NEIGHBOR_CHECK.append((i,j))
    
    def GenerateRooms(self,objectList,idx):
        sc.doc = rh.RhinoDoc.ActiveDoc
        roomIndex = sc.doc.Layers.Find("ROOM_AREA",True)
        sc.doc = ghdoc
        newRoom = []
        roomCoord = []
        roomCoordGroup = []
        roomGroup = []
        for oi in objectList:
            if oi.Attributes.LayerIndex == roomIndex:
                #pos = rs.GetUserText(oi,"TargetCoord").split(",")
                if oi.GetType() == rh.DocObjects.PointObject:
                    roomCoord.append(oi.PointGeometry.Location)
                    roomCoordGroup.append(oi.GetGroupList())
                elif oi.GetType() == rh.DocObjects.CurveObject:
                    newRoom.append(House.Room(rs.GetUserText(oi,"RName"),27,100,oi.Geometry,rs.GetUserText(oi,"Lamp"), rs.GetUserText(oi,"Resource"),idx))
                    rh.Geometry.PointContainment.Inside
                    roomGroup.append(oi.GetGroupList())
        Global.Logger.LogDebug("G count "+str(len(roomCoord))+" "+str(len(roomCoordGroup))+"\n")
        i = 0;
        for (coord,rCGroup) in zip(roomCoord,roomCoordGroup):
            Global.Logger.LogDebug("iterate "+str(i))
            i+=1
            paired = False
            Global.Logger.LogDebug("Room coord "+str(coord)+" group "+str(rCGroup)+"\n")
            for g in rCGroup:
                for (room,rGroup) in zip(newRoom,roomGroup):
                    Global.Logger.LogDebug("Room "+room.m_name+" group "+str(rGroup)+"\n")
                    if rGroup == None:
                        continue
                    for rg in rGroup:
                        if g == rg:
                            room.AddTargetCoord(coord)# SetTargetCoord(coord)
                            paired = True
                            break
                    if paired:
                        break
                if paired:
                    break
            Global.Logger.LogDebug("end loop\n")
        self.m_rooms.extend(newRoom)
        self.LoadLightAndTemperatureTable()
        Global.Logger.DumpDebug()
    def InitializeGrid(self,area,idx):
        print "intinialisazuuuu "+str(idx)
        import rhinoscriptsyntax as rs
        self.GenerateNeighborCheck()
        
        sc.doc = rh.RhinoDoc.ActiveDoc
        groundIndex = sc.doc.Layers.Find("ARS-LANTAI",True)
        sc.doc = ghdoc
        
        entryPointObject = []
        targetPointObject = []
        
        self.polina = []
        #get nurbscurve or rectangle
        rectArea = rs.coercecurve(area)
        
        minX = min(rectArea.Points[0].Location[0],rectArea.Points[2].Location[0])
        maxX = max(rectArea.Points[0].Location[0],rectArea.Points[2].Location[0])
        
        minY = min(rectArea.Points[0].Location[1],rectArea.Points[2].Location[1])
        maxY = max(rectArea.Points[0].Location[1],rectArea.Points[2].Location[1])
        
        #get width/height of the area and gridCount
        gridCountW = abs(int(math.ceil(maxX/self.gridSize)) - int(math.floor(minX/self.gridSize)))
        
        gridCountH = abs(int(math.ceil(maxY/self.gridSize)) - int(math.floor(minY/self.gridSize)))
        
        #initialize grid array
        curGrids = [[STATE_FREE for i in range(gridCountH)]for j in range(gridCountW)]
        curAdditionalWeight = [[0 for i in range(gridCountH)]for j in range(gridCountW)]
        curTargets = []
        curEntries = []
        
        gridStartX = float(math.floor(minX/self.gridSize)) * self.gridSize
        gridStartY = float(math.ceil(maxY/self.gridSize)) * self.gridSize
        
        if rectArea:
            rh.DocObjects.Tables.ObjectTable.UnselectAll(rh.RhinoDoc.ActiveDoc.Objects)
            #get objects inside the region
            rc,pl = rectArea.TryGetPolyline()
            view = sc.doc.Views.ActiveView.ActiveViewport
            objectList = rh.RhinoDoc.ActiveDoc.Objects.FindByCrossingWindowRegion(view,pl,True,rh.DocObjects.ObjectType.AnyObject)#rh.DocObjects.ObjectType.Curve|rh.DocObjects.ObjectType.Point|rh.DocObjects.ObjectType.InstanceDefinition)
            
            doorFrame = {}
            doorPanel = {}
            
            for oi in objectList:
                if rs.GetUserText(oi,"Type") == "Door":
                    part = rs.GetUserText(oi,"Part")
                    id = rs.GetUserText(oi, "ID")
                    if part == "Panel":
                        if id in doorPanel.keys():
                            doorPanel[id].append(oi)
                        else:
                            doorPanel[id] = [oi]
                    elif part == "Frame":
                         if id in doorFrame.keys():
                            doorFrame[id].append(oi)
                         else:
                            doorFrame[id] = [oi]
                    continue
                
                if oi.Attributes.LayerIndex == groundIndex or rs.GetUserText(oi,"IgnoreGrid") != None:
                    continue
                
                if oi.ObjectType == rh.DocObjects.ObjectType.Point:
                    if rs.GetUserText(oi,"Target") != None:
                        type = rs.GetUserText(oi,"Type")
                        if type == None:
                            type = "Other"
                        usage = rs.GetUserText(oi,"Usage")
                        pUsage = 0 if usage == None else float(usage)
                        active = rs.GetUserText(oi,"Active") != None
                        envEffect = rs.GetUserText(oi,"EnvEffect")
                        if envEffect == None:
                            envEffect = "-"
                        autoTrigger = rs.GetUserText(oi,"Trigger")
                        if autoTrigger == None:
                            autoTrigger = "-"
                        target = Target.Target(idx,type,envEffect,oi.PointGeometry.Location,rs.GetUserText(oi,"ID"),pUsage, active,autoTrigger)
                        targetPointObject.append(oi)
                        specific = rs.GetUserText(oi,"Specific")
                        if specific != None:
                            specList = specific.split(',')
                            for spec in specList:
                                target.setSpecificAgent(int(spec))
                        activity = rs.GetUserText(oi,"Activity")
                        if activity != None:
                            actList = activity.split(',')
                            for act in actList:
                                target.setActivity(act)
                        curTargets.append(target)
                    if rs.GetUserText(oi,"Entry") != None:
                        entryPointObject.append(oi)
                        curEntries.append(EntryPoint.EntryPoint(oi.PointGeometry.Location,idx))
                    continue
                    
                if oi.GetType() == rh.DocObjects.InstanceObject:
                    Global.Logger.LogDebug("opite "+str(oi.Geometry.GetType())+"\n")
                    bbox = oi.Geometry.GetBoundingBox(rh.Geometry.Plane.WorldXY)
                    sc.doc = rh.RhinoDoc.ActiveDoc
                    new = rs.CopyObject(oi.Id)
                    blockInstanceElements = rs.ExplodeBlockInstance(new,True)
                    curveBlockInstanceElements = []
                    for elm in blockInstanceElements:
                        cv = rs.coercecurve(elm)
                        if cv != None:
                            curveBlockInstanceElements.append(cv)
                    sc.doc=ghdoc
                    Global.Logger.DumpDebug()
                elif oi.GetType() == rh.DocObjects.CurveObject:
                    curve = oi.CurveGeometry
                    if not curve:
                        continue
                    bbox = curve.GetBoundingBox(True)
                else:
                    continue
                if not bbox.IsValid: continue
                
                xMin = int(((float(math.floor((bbox.Min.X - self.WALL_DISTANCE)/self.gridSize)) * self.gridSize) - gridStartX)/self.gridSize)
                xMax = int(((float(math.ceil((bbox.Max.X + self.WALL_DISTANCE)/self.gridSize)) * self.gridSize) - gridStartX)/self.gridSize)
                yMin = int((gridStartY - (float(math.floor((bbox.Min.Y - self.WALL_DISTANCE)/self.gridSize)) * self.gridSize))/self.gridSize)
                yMax = int((gridStartY - (float(math.ceil((bbox.Max.Y + self.WALL_DISTANCE)/self.gridSize)) * self.gridSize))/self.gridSize)
            
                for i in range(yMax,yMin+1):
                    for j in range(xMin,xMax+1):
                        if i >= gridCountH or j >= gridCountW or i < 0 or j < 0:
                            continue
                        cRect = rh.Geometry.Rectangle3d(rh.Geometry.Plane.WorldXY,rg.Point3d(gridStartX+(j*self.gridSize),gridStartY-(i*self.gridSize),0),rg.Point3d(gridStartX+((j+1)*self.gridSize),gridStartY-((i+1)*self.gridSize),0))
                        if oi.GetType() == rh.DocObjects.InstanceObject:
                            for elm in curveBlockInstanceElements:
                                inter = rg.Intersect.Intersection.CurveCurve(elm,cRect.ToNurbsCurve(),self.WALL_DISTANCE,0)
                                if inter:
                                    curGrids[j][i] = STATE_BLOCKED
                                    self.polina.append(cRect)
                        else:
                            inter = rg.Intersect.Intersection.CurveCurve(oi.CurveGeometry,cRect.ToNurbsCurve(),self.WALL_DISTANCE,0)
                            if inter:
                                curGrids[j][i] = STATE_BLOCKED
                                self.polina.append(cRect)
                if oi.GetType() == rh.DocObjects.InstanceObject:
                    sc.doc = rh.RhinoDoc.ActiveDoc
                    rs.DeleteObjects(blockInstanceElements)
                    sc.doc=ghdoc
            
            self.GenerateRooms(objectList,idx)
            Global.Logger.LogDebug("dorami\n"+str(doorFrame)+"\n")
            Global.Logger.LogDebug("dopami\n"+str(doorPanel)+"\n")
            for doorFrameId in doorFrame.keys():
                if doorFrameId in doorPanel.keys():
                    frameBoundingBox = rh.Geometry.BoundingBox.Union(doorFrame[doorFrameId][0].Geometry.GetBoundingBox(True),doorFrame[doorFrameId][1].Geometry.GetBoundingBox(True))
                    panels = []
                    for panel in doorPanel[doorFrameId]:
                        rotCenter, rotDir = self.DetermineRotationCenterAndDir(frameBoundingBox,panel)
                        panelTuple = (panel, rotCenter, rotDir)
                        panels.append(panelTuple)
                    
                    frameCorner = frameBoundingBox.GetCorners()
                    
                    isVertical = (frameCorner[2].X - frameCorner[0].X < frameCorner[2].Y - frameCorner[0].Y)
                    #frameBoundingBox.Inflate(0.2 if isVertical else 0, 0 if isVertical else 0.2, 0)
                    frameRect = rh.Geometry.Rectangle3d(rh.Geometry.Plane.WorldXY, frameCorner[0], frameCorner[2]).ToNurbsCurve()
                    #rh.Geometry.Intersect.Intersection.CurveCurve
                    door = Door.Door(panels, frameRect, rs.GetUserText(doorFrame[doorFrameId][0],"Room"))
                    self.m_doors.append(door)
            
        #make way for entry
        for (epObject,ep) in zip(entryPointObject,curEntries):
            gridEpX = int(math.floor((ep.pos.X - gridStartX)/self.gridSize))
            gridEpY = int(math.floor((gridStartY - ep.pos.Y)/self.gridSize))
            
            curGrids[gridEpX][gridEpY] = STATE_ENTRY
            epGroupList = epObject.GetGroupList()
            dir = rs.GetUserText(epObject,"Direction")
            checker = 5
            if dir == "LEFT":
                for i in range(-1,-checker,-1):
                    if curGrids[gridEpX + i][gridEpY] == STATE_BLOCKED:
                        curGrids[gridEpX + i][gridEpY] = STATE_FREE
                    elif curGrids[gridEpX + i][gridEpY] == STATE_FREE:
                        break
            elif dir == "RIGHT":
                for i in range(1,checker):
                    if curGrids[gridEpX + i][gridEpY] == STATE_BLOCKED:
                        curGrids[gridEpX + i][gridEpY] = STATE_FREE
                    elif curGrids[gridEpX + i][gridEpY] == STATE_FREE:
                        break
            elif dir == "UP":
                for i in range(-1,-checker,-1):
                    if curGrids[gridEpX][gridEpY + i] == STATE_BLOCKED:
                        curGrids[gridEpX][gridEpY + i] = STATE_FREE
                    elif curGrids[gridEpX][gridEpY + i] == STATE_FREE:
                        break
            elif dir == "DOWN":
                for i in range(1,checker):
                    if curGrids[gridEpX][gridEpY + i] == STATE_BLOCKED:
                        curGrids[gridEpX][gridEpY + i] = STATE_FREE
                    elif curGrids[gridEpX][gridEpY + i] == STATE_FREE:
                        break
            for (tObject,target) in zip(targetPointObject,curTargets):
                #entrypoint and targetpoint is similar
                if epObject.Geometry.Location == tObject.Geometry.Location:
                    ep.target = target
                    break
                    
                #entrypoint different with targetpoint
                targetGroupList = tObject.GetGroupList()
                counter = 0
                #target and entry point must have all their group similar
                if targetGroupList == None or epGroupList == None:
                    continue
                for tGroup in targetGroupList:
                    for eGroup in epGroupList:
                        if tGroup == eGroup:
                            counter +=1
                            break
                if counter == len(targetGroupList):
                    ep.target = target
                    break
        
        #calculate additional weight, to make agent not walk to close with object or wall
        for i in range(len(curGrids[0])):
            for j in range(len(curGrids)):
                for neighbor in self.NEIGHBOR_CHECK:
                    toCheckX = i + neighbor[0]
                    toCheckY = j + neighbor[1]
                    
                    #out of area
                    if (toCheckX < 0) or (toCheckX >= gridCountH) or (toCheckY < 0) or (toCheckY >= gridCountW):
                        continue
                    
                    #wall
                    if curGrids[j][i] == STATE_BLOCKED:
                        continue
                    
                    if curGrids[toCheckY][toCheckX] == STATE_BLOCKED:
                        curAdditionalWeight[j][i] = max(curAdditionalWeight[j][i],(self.NEIGHBOR_DIS - max(abs(neighbor[0]),abs(neighbor[1])) + 1) * self.gridSize * 100)
                    
        sc.doc = rh.RhinoDoc.ActiveDoc
        furnitureIndex = sc.doc.Layers.Find("ARS-FURNITURE",True)
        sc.doc = ghdoc
        #Rhino.DocObjects.ObjectType.InstanceReference
        #homeFurniture = [object for object in objectList if (object.ObjectType != rh.DocObjects.ObjectType.Point and object.Attributes.LayerIndex == furnitureIndex)]
        homeFurniture = [object for object in objectList if (object.ObjectType == rh.DocObjects.ObjectType.InstanceReference and object.Attributes.LayerIndex == furnitureIndex)]
        print "homik "+str(len(homeFurniture))
        #honca = 
        homeObjects = []
        homeGroupList = []
        for hf in homeFurniture:
            index = 0
            hfGroup = hf.GetGroupList()
            haveSame = False
            if hfGroup != None:
                for (idx,gList) in enumerate(homeGroupList):
                    if gList != None:
                        haveSame = any(item in hfGroup for item in gList)
                        if haveSame:
                            index = idx
                            break
            if haveSame:
                homeObjects[index].AddParts(hf)
                homeGroupList[index] += hfGroup
                homeGroupList[index] = list(set(homeGroupList[index]))
            else:
                hObject = HomeObject.HomeObject()
                hObject.AddParts(hf)
                homeObjects.append(hObject)
                homeGroupList.append(hfGroup)
        
        for (tObject,target) in zip(targetPointObject,curTargets):
            targetGroupList = tObject.GetGroupList()
            for room in self.m_rooms:
                if room.CheckAndAddItem(target):
                    break
            if targetGroupList == None:
                continue
            for (hfGroup,hObject) in zip(homeGroupList,homeObjects):
                if hfGroup == None:
                    continue
                haveSame = any(item in targetGroupList for item in hfGroup)
                if haveSame:
                    hObject.AddTargetPoint(target)
                    if not(hObject in room.m_object):
                        room.m_object.append(hObject)
                
        entryToRemove = []
        for entry in curEntries:
            #EntryPoint.EntryPoint.
            ids = entry.target.m_id.split(";")
            #Global.Logger.LogDebug(str(ids)+"\n")
            if len(ids) > 1:
                for id in ids:
                    nTarget = entry.target.CreateCopyForId(id)
                    nEntry = entry.CreateCopyForTarget(nTarget)
                    curEntries.append(nEntry)
                    curTargets.append(nTarget)
                entryToRemove.append(entry)
        for entry in entryToRemove:
            curTargets.remove(entry.target)
            curEntries.remove(entry)
        
        HomeObject.HomeObject.HomeObjectList = homeObjects
        self.gridInitialized = True
            
        self.topPos.append(Point3d(gridStartX,gridStartY,0))
        self.grids.append(curGrids)
        self.additionalWeight.append(curAdditionalWeight)
        self.possibleTarget = self.possibleTarget + curTargets
        self.entryPoint = self.entryPoint + curEntries
        Global.g_myHouse.m_rooms = self.m_rooms
        Global.Logger.DumpDebug()
        
    def LoadLightAndTemperatureTable(self):
        Global.Logger.LogDebug("Load tempest\n")
        tableLight = {}
        tableTemperature = {}
        
        cFPath = ghenv.Component.OnPingDocument().FilePath
        cpath = cFPath[0:cFPath.rfind('\\')+1]
        resPath = cpath+'..\\res\\'+self.m_mapName+'\\'
        
        lightFile = resPath+Config.ROOM_LIGHT_FILE
        
        with open(lightFile) as csvfile:
            reader = csv.reader(csvfile)
            columnTable = []
            for row in reader:
                if row[0] == "Day":
                    for i in range(2,len(row)):
                        columnTable.append(row[i])
                        tableLight[row[i]] = []
                else:
                    for i in range(2,len(row)):
                        tableLight[columnTable[i-2]].append(float(row[i]))
        
        temperatureFile = resPath+Config.ROOM_TEMPERATURE_FILE
        with open(temperatureFile) as csvfile:
            reader = csv.reader(csvfile)
            columnTable = []
            for row in reader:
                if row[0] == "Day":
                    for i in range(2,len(row)):
                        columnTable.append(row[i])
                        tableTemperature[row[i]] = []
                else:
                    for i in range(2,len(row)):
                        tableTemperature[columnTable[i-2]].append(float(row[i]))
        
        Global.Logger.LogDebug("daki table "+str(tableLight.keys())+"\n")
        for room in self.m_rooms:
            if room.m_name in tableLight.keys():
                room.SetLightAndTemperatureTable(tableLight[room.m_name], tableTemperature[room.m_name])
        
    def DetermineRotationCenterAndDir(self, frameBox, panel):
        panelBox = panel.Geometry.GetBoundingBox(True)
        panelCenter = panelBox.Center
        
        frameCenter = frameBox.Center
        
        panelCorner = panelBox.GetCorners()
        isPanelVertical = (panelCorner[2].X - panelCorner[0].X < panelCorner[2].Y - panelCorner[0].Y)
        index = 0
        direction = DIRECTION_CCW
        if isPanelVertical:
            if frameCenter.X > panelCenter.X:
                if frameCenter.Y > panelCenter.Y:
                    index = 3
                else:
                    index = 0
                    direction = DIRECTION_CW
            else:
                if frameCenter.Y > panelCenter.Y:
                    index = 2
                    direction = DIRECTION_CW
                else:
                    index = 1
        else:
            if frameCenter.X > panelCenter.X:
                if frameCenter.Y > panelCenter.Y:
                    index = 1
                    direction = DIRECTION_CW
                else:
                    index = 2
            else:
                if frameCenter.Y > panelCenter.Y:
                    index = 0
                else:
                    index = 3
                    direction = DIRECTION_CW
        rotationCenter = panelCorner[index]
        
        if isPanelVertical:
            if index == 0 or index == 3:
                rotationCenter.X += OFFSET
            else:
                rotationCenter.X -= OFFSET
        else:
            if index == 0 or index == 1:
                rotationCenter.Y += OFFSET
            else:
                rotationCenter.Y -= OFFSET
        return rotationCenter, direction
        
    def RunScript(self, area,counter,reset, mapName):
        print "asaw"
        self.m_mapName = mapName
        #self.LoadLightAndTemperatureTable()
        gridArea = None
        topPos = None
        entryPoints = None
        """Provides a scripting component.
            Inputs:
                x: The x script variable
                y: The y script variable
            Output:
                a: The a output variable"""
        
        __author__ = "andri.setiawan"
        __version__ = "2020.03.16"
        
        #rect1 = rh.Geometry.Rectangle3d(rh.Geometry.Plane.WorldXY, rh.Geometry.Point3d(0,0,0), rh.Geometry.Point3d(3,3,0))
        #line = rh.Geometry.Line(rh.Geometry.Point3d(1,2,0),rh.Geometry.Point3d(1,1,0))
        
        #conta = rh.Geometry.Intersect.Intersection.CurveCurve(rect1.ToNurbsCurve(),line.ToNurbsCurve(),0,0)
        #print("ss "+str(conta.Count))
        #rh.Geometry.Intersect.CurveIntersections.Count
        import rhinoscriptsyntax as rs
        import sys
        
        print reset
        if reset:
            self.gridInitialized = False
            self.isRun = False
            return None,None,None
        
        if (not self.isRun) and (not reset):
            self.isRun = True
            self.grids = []
            self.gridInitialized = False
            self.topPos = []
            self.possibleTarget = []
            self.entryPoint = []
            
        if not self.gridInitialized:
            self.m_mapName = mapName
            self.m_rooms = []
            Global.Logger.LogDebug("initsukopet\n")
            PathFinding.Map.actualRect = []
            for (idx,floor) in enumerate(area):
                Global.Logger.LogDebug("initsukopet "+str(idx)+" "+str(floor)+"\n")
                self.InitializeGrid(floor,idx)
                curveFloor = rs.coercecurve(floor)
                PathFinding.Map.actualRect.append(curveFloor)
            PathFinding.Map.InitNode()
            for target in self.possibleTarget:
                Global.Logger.LogDebug( "torogenta "+str(target.m_targetPoint)+" "+str(target.m_floorIndex) +"\n")
            Global.Logger.LogDebug("yahukimo")
            Global.Logger.DumpDebug()
            sc.sticky["PossibleTarget"] = self.possibleTarget
            sc.sticky["EntryPoint"] = self.entryPoint
            Global.g_myHouse.m_doors = self.m_doors

        gridArea = self.grids
        topPos = self.topPos
        #possibleTarget = self.possibleTarget
        #entryPoints = self.entryPoint
        additionalWeight = self.additionalWeight
        
        
        #print "maze"
        #for i in range(len(self.grids[0][0])):
            #s = ""
            #for j in range(len(self.grids[0])):
                #s+=(str(self.grids[0][j][len(self.grids[0][0]) - i -1])+" ")
            #print s
        #print "weight"
        #for i in range(len(self.grids[0])):
            #s = ""
            #for j in range(len(self.grids)):
                #s+=(str(int(self.additionalWeight[j][len(self.additionalWeight[0]) - i -1]/10))+" ")
            #print s
    
        #Global.g_myHouse.m_rooms = self.m_rooms
        
        return gridArea,topPos,additionalWeight,self.m_rooms,None #self.polina
# ---------- end gridgenerator ----------
agentgenerator = GhPythonScript(agentPos=python_2, initialState=initial_state, reset=python, ActiveAgent=python_4.ActiveAgent, rooms=gridgenerator.rooms)  # -> agentList; inputs agentPos: list, initialState: list of Int32, reset: Boolean, ActiveAgent: list of Boolean, rooms: list
# ---------- agentgenerator: Python ----------
from ghpythonlib.componentbase import executingcomponent as component
import Grasshopper, GhPython
import System
import Rhino
import rhinoscriptsyntax as rs
import sys
import itertools
import scriptcontext as sc
from Rhino.Geometry import Point3d

import csv

cFPath = ghenv.Component.OnPingDocument().FilePath
cpath = cFPath[0:cFPath.rfind('\\')+1]
my_path = cpath+'..\source'
if not my_path in sys.path:
    sys.path.append(my_path)

import Agent
Agent = reload(Agent)
import CommonEnum
import Activity
Activity = reload(Activity)
import Global

class MyComponent(component):
    def __init__(self):
        self.m_isRun = False
        self.m_agentList = None
        self.m_isAgentInitialized = False
        
    def InitalizeAgent(self, agentPos,initialState, ActiveAgent):
        self.m_agentList = []
        for index,(pos,state) in enumerate(itertools.izip_longest(agentPos,initialState)):
            if index < len(agentPos) and ActiveAgent[index]:
                tState = Agent.STATE_IDLE
                if index < len(initialState):
                    tState = state
                role = rs.GetUserText(pos,"Role")
                agent = Agent.Agent(pos.PointGeometry.Location,Point3d(0,0,0),index,role,state)
                agent.m_active = ActiveAgent[index]
                self.m_agentList.append(agent)
        self.m_isAgentInitialized = True
        
    def RunScript(self, agentPos, initialState, reset, ActiveAgent, rooms):
        if reset:
            self.m_isAgentInitialized = False
            return None
            
        if (not self.m_isRun) and (not reset):
            self.m_isRun = True
            self.m_agentList = None
            
        if not self.m_isAgentInitialized:
            Global.g_timer.ResetTimer()
            Global.g_myHouse.ResetEnergyUsage()
            Activity.LoadMultiAgent()
            self.InitalizeAgent(agentPos, initialState, ActiveAgent)
            for agent in Agent.Agent.agentList:
                print agent.m_socialValue
        """Provides a scripting component.
            Inputs:
                x: The x script variable
                y: The y script variable
            Output:
                a: The a output variable"""
        
        __author__ = "remote"
        __version__ = "2020.03.24"
        
        import rhinoscriptsyntax as rs
        
        # return outputs if you have them; here I try it for you:
        return self.m_agentList
# ---------- end agentgenerator ----------

# ----
ghpython_script = GhPythonScript(agent=agentgenerator, reset=python)  # -> a; inputs agent: list
# ---------- ghpython_script: Python ----------
from ghpythonlib.componentbase import executingcomponent as component
import Grasshopper, GhPython
import System
import Rhino
import rhinoscriptsyntax as rs
import Rhino.UI
import Eto.Drawing as drawing
import Eto.Forms as forms

import sys
cFPath = ghenv.Component.OnPingDocument().FilePath
cpath = cFPath[0:cFPath.rfind('\\')+1]
my_path = cpath+'..\source'
if not my_path in sys.path:
    sys.path.append(my_path)
    
import Agent
Agent = reload(Agent)
import Global
import Common


class TestForm(forms.Form):
    def __init__(self):
        self.layout = forms.DynamicLayout()
        self.text = forms.Label(Text = "-1")
        self.layout.AddRow(self.text)
        self.Content = self.layout
        self.counter = -1
        
    def UpdateForm(self):
        self.counter += 1
        self.text.Text = str(self.counter)

class ActivityViewer(forms.Form):
    def __init__(self):
        self.m_agentList = None
        self.Title = "Agent Activity"
        self.Padding = drawing.Padding(10)
        
        self.layout = forms.DynamicLayout()
        self.layout.Spacing = drawing.Size(5,5)
        self.layout.Padding = drawing.Padding(10)
        nLabel = forms.Label()
        
        self.layout.AddRow(nLabel)
        
        self.Content = self.layout
        
    def SetAgent(self, agentList):
        self.m_agentList = agentList
    
    def SetupLayout(self):
        self.m_timeText = forms.Label(Text = "Day "+str(Global.g_timer.GetDay())+" at "+Global.g_timer.GetFormattedHour())
        self.layout.AddRow(self.m_timeText)
        self.m_agentText = []
        for agent in self.m_agentList:
            agentText = agent.m_role + " : "
            if agent.m_currentActivity != None:
                agentText += agent.m_currentActivity.m_ID+" - "+agent.m_currentActivity.m_description
            else:
                agentText += "No Activity"
            textLabel = forms.Label(Text = agentText)
            self.layout.AddRow(textLabel)
            self.m_agentText.append(textLabel)
        header = ["Resource", "Last Usage", "Last User", "Device", "User Activity", "Total"]
        self.m_resGrid = forms.GridView()
        for i in range(len(header)):
            column = forms.GridColumn()
            column.HeaderText = header[i]
            column.DataCell = forms.TextBoxCell(i)
            self.m_resGrid.Columns.Add(column)
            self.m_resGrid.Columns[i].Visible = True
        
        data = []
        res = [["Electricity", Common.ENERGY_TYPE_ELECTRICITY], ["Water", Common.ENERGY_TYPE_WATER], ["Gas", Common.ENERGY_TYPE_GAS]]
        for resArr in res:
            rowData = [resArr[0]]
            hData = Global.g_myHouse.GetLastUsage(resArr[1])
            rowData.extend(hData)
            data.append(rowData)
        self.m_resGrid.DataStore = data
        self.layout.AddRow(self.m_resGrid)
        self.Content = self.layout
        
    def UpdateForm(self):
        self.m_timeText.Text = "Day "+str(Global.g_timer.GetDay())+" at "+Global.g_timer.GetFormattedHour()
        for i in range(0, len(self.m_agentText)):
            agentText = self.m_agentList[i].m_role + " : "
            if self.m_agentList[i].m_currentActivity != None:
                agentText += self.m_agentList[i].m_currentActivity.m_ID+" - "+self.m_agentList[i].m_currentActivity.m_description
            else:
                agentText += "No Activity"
            self.m_agentText[i].Text = agentText
        res = [["Electricity", Common.ENERGY_TYPE_ELECTRICITY], ["Water", Common.ENERGY_TYPE_WATER], ["Gas", Common.ENERGY_TYPE_GAS]]
        data = []
        for resArr in res:
            rowData = [resArr[0]]
            hData = Global.g_myHouse.GetLastUsage(resArr[1])
            rowData.extend(hData)
            data.append(rowData)
        self.m_resGrid.DataStore = data
        """layout = forms.DynamicLayout()
        layout.Spacing = drawing.Size(5,5)
        layout.Padding = drawing.Padding(10)
        
        timeText = "Day "+str(Global.g_timer.GetDay())+" at "+Global.g_timer.GetFormattedHour()
        timeLabel = forms.Label(Text = timeText)
        layout.AddRow(timeLabel)
        
        for agent in self.m_agentList:
            if agent == None:
                continue
            
            agentText = agent.m_role + " : "
            if agent.m_currentActivity != None:
                agentText += agent.m_currentActivity.m_ID+" - "+agent.m_currentActivity.m_description
            else:
                agentText += "No Activity"
            
            agentLabel = forms.Label(Text = agentText)
            layout.AddRow(agentLabel)
        layout.AddRow(None)"""
        
        """header = ["Resource", "Last Usage", "Last User", "Device", "User Activity", "Total"]
        resGrid = forms.GridView()
        for i in range(len(header)):
            column = forms.GridColumn()
            column.HeaderText = header[i]
            column.DataCell = forms.TextBoxCell(i)
            resGrid.Columns.Add(column)
            resGrid.Columns[i].Visible = True
        
        data = []
        res = [["Electricity", Common.ENERGY_TYPE_ELECTRICITY], ["Water", Common.ENERGY_TYPE_WATER], ["Gas", Common.ENERGY_TYPE_GAS]]
        for resArr in res:
            rowData = [resArr[0]]
            hData = Global.g_myHouse.GetLastUsage(resArr[1])
            rowData.extend(hData)
            data.append(rowData)
        resGrid.DataStore = data
        layout.AddRow(resGrid)
        #forms.DynamicLayout.AddRow(
        #layout.Add(table)"""
        
        #self.Content = layout
    
class MyComponent(component):
    def __init__(self):
        self.m_formCreated = False
        self.m_formShown = False
        self.m_form = None
    
    def RunScript(self, agent, reset):
        """Provides a scripting component.
            Inputs:
                x: The x script variable
                y: The y script variable
            Output:
                a: The a output variable"""
        
        if reset:
            self.m_formCreated = False
            self.m_formShown = False
            if self.m_form != None:
                self.m_form.Close()
                self.m_form = None
            return None
        
        print str(self.m_formCreated)+" "+str(self.m_formShown)
        if not self.m_formCreated:
            #self.m_form = TestForm()
            self.m_form = ActivityViewer()
            self.m_form.SetAgent(agent)
            self.m_form.SetupLayout()
            self.m_form.UpdateForm()
            self.m_form.Show()
            self.m_formShown = True
            self.m_formCreated = True
        
        if self.m_formShown:
            self.m_form.UpdateForm()
        
        __author__ = "LENOVO"
        __version__ = "2022.06.07"
        
        import rhinoscriptsyntax as rs
        a = 0
        
        # return outputs if you have them; here I try it for you:
        return a
# ---------- end ghpython_script ----------
panel = Panel(c_script.deltaTime)

# ---- group: Information Display
checkselectedobject = GhPythonScript(counter=c_script.deltaTime, reset=python)  # -> anySelected
# ---------- checkselectedobject: Python ----------
from ghpythonlib.componentbase import executingcomponent as component
import Grasshopper, GhPython
import System
import Rhino
import rhinoscriptsyntax as rs

from Rhino.DocObjects import BrepObject


import scriptcontext as sc
import Rhino as rh
        
import System
import Rhino.UI
import Eto.Drawing as drawing
import Eto.Forms as forms

import csv
        
maxAttributes = 0
#forms.DynamicLayout.AddSpace(
templates = []

class ObjectTemplate():
    def __init__(self,name):
        self.name = name
        self.attributes = []
        self.activities = []
        
    def AddAttribute(self,key,value):
        self.attributes.append((key,value))
    
    def AddActivity(self,key,value):
        self.activities.append((key,value))

class SelectTemplateDialog(forms.Dialog[bool]):
    def __init__(self,obj):
        self.object = obj
        self.Title = "Select Template"
        self.templateChoice = []
        self.Resizable = False
        self.Padding = drawing.Padding(10)
        for tmpl in templates:
            self.templateChoice.append(tmpl.name)
        self.rGroup = forms.RadioButtonList()
        self.rGroup.DataStore = self.templateChoice
        self.rGroup.Orientation = forms.Orientation.Vertical
        self.rGroup.SelectedIndex = 0
        self.rGroup.SelectedIndexChanged += self.UpdateAttribute
        self.layoutChoice = forms.DynamicLayout()
        self.layoutChoice.Spacing = drawing.Size(5, 5)
        self.layoutChoice.AddRow(self.rGroup)
        self.layoutChoice.Padding = drawing.Padding(10)
        self.layout = forms.DynamicLayout()
        self.layout.Spacing = drawing.Size(5, 5)
        self.layout.Padding = drawing.Padding(10)
        self.layoutAttribute = forms.DynamicLayout()
        self.layoutAttribute.Spacing = drawing.Size(5, 5)
        self.layoutAttribute.Padding = drawing.Padding(10)
        self.layoutAttribute.AddRow(forms.Label(Text = "Attributes"))
        self.layoutAttributeTextBox = []
        for attr in templates[self.rGroup.SelectedIndex].attributes:
            textBox = forms.TextBox(Text = attr[1])
            self.layoutAttribute.AddRow(forms.Label(Text = attr[0]),textBox)
            self.layoutAttributeTextBox.append(textBox)
        if len(templates[self.rGroup.SelectedIndex].attributes) < maxAttributes:
            for i in range(len(templates[self.rGroup.SelectedIndex].attributes), maxAttributes):
                nLabel = forms.Label()
                #nLabel.Visible = False
                nText = forms.TextBox()
                self.layoutAttributeTextBox.append(nText)
                nText.Enabled = False
                self.layoutAttribute.AddRow(nLabel,nText)
        
        self.layoutActivity = forms.DynamicLayout()
        self.layoutActivity.Spacing = drawing.Size(5, 5)
        self.layoutActivity.Padding = drawing.Padding(10)
        self.layoutActivity.AddRow(forms.Label(Text = "Activity"))
        self.layoutActivityTextBox = []
        for act in templates[self.rGroup.SelectedIndex].activities:
            textBox = forms.TextBox(Text = act[1])
            self.layoutActivity.AddRow(forms.Label(Text = act[0]),textBox)
            self.layoutActivityTextBox.append(textBox)
        self.layoutActivity.AddSpace()
        
        #self.layoutAttribute.AddRow(None)
        self.layout.AddRow(self.layoutChoice,self.layoutAttribute,self.layoutActivity,self.layoutActivity)
        #cc = self.layoutAttribute.Children
        #print cc[0]
        #layout.AddColumn(layoutAttribute)
        # Create the default button
        self.DefaultButton = forms.Button(Text = 'Save')
        self.DefaultButton.Click += self.OnOKButtonClick
        
        # Create the abort button
        self.AbortButton = forms.Button(Text = 'Cancel')
        self.AbortButton.Click += self.OnCloseButtonClick
        buttonLayout = forms.DynamicLayout()
        
        buttonLayout.Spacing = drawing.Size(5, 5)
        buttonLayout.Padding = drawing.Padding(10)
        buttonLayout.AddRow(self.DefaultButton,self.AbortButton)
        self.layout.AddRow(None,buttonLayout)
        
        self.Content = self.layout
        
    def OnCloseButtonClick(self, sender, e):
        #self.m_textbox.Text = ""
        self.Close(False)
        
            # OK button click handler
    def OnOKButtonClick(self, sender, e):
        #if self.m_textbox.Text == "":
            #self.Close(False)
        #else:
        for obj in self.object:
            rs.SetUserText(obj,"ObjectType",templates[self.rGroup.SelectedIndex].name)
            print len(templates[self.rGroup.SelectedIndex].attributes)
            print len(self.layoutAttributeTextBox)
            for (attr,textBox) in zip(templates[self.rGroup.SelectedIndex].attributes,self.layoutAttributeTextBox):
                rs.SetUserText(obj,"Attribute."+attr[0],textBox.Text)
            for (act,textBox) in zip(templates[self.rGroup.SelectedIndex].activities,self.layoutActivityTextBox):
                rs.SetUserText(obj,"Activity."+act[0],textBox.Text)
        self.Close(True)
        
    def UpdateAttribute(self,sender,e):
        print "asooooooooooooooooo"
        #forms.DynamicLayout.Remove(
        layout = forms.DynamicLayout()
        layout.Spacing = drawing.Size(5, 5)
        layout.Padding = drawing.Padding(10)
        self.layoutAttribute = forms.DynamicLayout()
        self.layoutAttribute.Spacing = drawing.Size(5, 5)
        self.layoutAttribute.Padding = drawing.Padding(10)
        self.layoutAttribute.AddRow(forms.Label(Text = "Attributes"))
        self.layoutAttributeTextBox = []
        for attr in templates[self.rGroup.SelectedIndex].attributes:
            textBox = forms.TextBox(Text = attr[1])
            self.layoutAttribute.AddRow(forms.Label(Text = attr[0]),textBox)
            self.layoutAttributeTextBox.append(textBox)
        if len(templates[self.rGroup.SelectedIndex].attributes) < maxAttributes:
            for i in range(len(templates[self.rGroup.SelectedIndex].attributes), maxAttributes):
                nLabel = forms.Label()
                #nLabel.Visible = False
                nText = forms.TextBox()
                self.layoutAttributeTextBox.append(nText)
                nText.Enabled = False
                self.layoutAttribute.AddRow(nLabel,nText)
        
        
        self.layoutActivity = forms.DynamicLayout()
        self.layoutActivity.Spacing = drawing.Size(5, 5)
        self.layoutActivity.Padding = drawing.Padding(10)
        self.layoutActivity.AddRow(forms.Label(Text = "Activity"))
        self.layoutActivityTextBox = []
        for act in templates[self.rGroup.SelectedIndex].activities:
            textBox = forms.TextBox(Text = act[1])
            self.layoutActivity.AddRow(forms.Label(Text = act[0]),textBox)
            self.layoutActivityTextBox.append(textBox)
        self.layoutActivity.AddSpace()
        
        layout.AddRow(self.layoutChoice,self.layoutAttribute,self.layoutActivity)
        print "assddd22"
        print self.layout.Size
        #self.Size.Height += 28
        print self.Size
        #drawing.Size.
        #layout.UpdateBindings()
        #forms.DynamicLayout.
        #layout.Invalidate(False)
        print str(layout.Height) + " "+str(layout.Width)
        buttonLayout = forms.DynamicLayout()
        
        buttonLayout.Spacing = drawing.Size(5, 5)
        buttonLayout.Padding = drawing.Padding(10)
        buttonLayout.AddRow(self.DefaultButton,self.AbortButton)
        layout.AddRow(None,buttonLayout)
        self.Content = layout
        self.layout = layout
        #self.Invalidate(False)
        #self.Initialize()
        #print "opeeeekkkk "+str(self.rGroup.SelectedIndex)
        #self.layoutAttribute.

class AttributeDialog(forms.Dialog[bool]):

    # Dialog box Class initializer
    def __init__(self,obj):
    # Initialize dialog box
        self.object = obj
        self.Title = 'Object Info'
        self.Padding = drawing.Padding(10)
        self.Resizable = False
 
        #keyStrings = rs.GetUserText(obj)

        self.keys = rs.GetUserText(obj[0])
        #self.m_attributeValues = []
        self.m_attributeLabels = []
        self.m_attributeTextboxes = []
        
        #self.m_activityValues = []
        self.m_activityLabels = []
        self.m_activityTextboxes = []

        # Create a table layout and add all the controls
        self.layout = forms.DynamicLayout()
        self.layout.Spacing = drawing.Size(5, 5)
        self.layoutAttribute = forms.DynamicLayout()
        self.layoutAttribute.Spacing = drawing.Size(5, 5)
        self.layoutActivity = forms.DynamicLayout()
        self.layoutActivity.Spacing = drawing.Size(5, 5)
        
        self.layoutAttribute.AddRow(forms.Label(Text = "Attribute:"))
        self.layoutActivity.AddRow(forms.Label(Text = "Activity:"))
        for (i,key) in enumerate(self.keys):
            if key == "ObjectType":
                self.layout.AddRow(forms.Label(Text = ("Object Type: " + rs.GetUserText(obj[0],key))))
            elif key.startswith("Attribute"):
                textBox = forms.TextBox(Text = rs.GetUserText(obj[0],key))
                label = forms.Label(Text = key[10:])
                self.layoutAttribute.AddRow(label,textBox)
                self.m_attributeLabels.append(label)
                self.m_attributeTextboxes.append(textBox)
            elif key.startswith("Activity"):
                textBox = forms.TextBox(Text = rs.GetUserText(obj[0],key))
                label = forms.Label(Text = key[9:])
                self.layoutActivity.AddRow(label,textBox)
                self.m_activityLabels.append(label)
                self.m_activityTextboxes.append(textBox)
                
        self.layoutAttribute.AddSpace()
        self.layoutActivity.AddSpace()
        self.layout.AddRow(self.layoutAttribute,self.layoutActivity)
        # Create the default button
        self.DefaultButton = forms.Button(Text = 'Save')
        self.DefaultButton.Click += self.OnOKButtonClick
        
        # Create the abort button
        self.AbortButton = forms.Button(Text = 'Cancel')
        self.AbortButton.Click += self.OnCloseButtonClick
        
        #for (label,text) in zip(self.m_labels,self.m_textboxes):
            #layout.AddRow(label, text)
        self.layout.AddRow(None) # spacer
        self.layout.AddRow(self.DefaultButton, self.AbortButton)
        
        # Set the dialog content
        self.Content = self.layout
    # Close button click handler
    def OnCloseButtonClick(self, sender, e):
        #self.m_textbox.Text = ""
        self.Close(False)
        
            # OK button click handler
    def OnOKButtonClick(self, sender, e):
        #if self.m_textbox.Text == "":
            #self.Close(False)
        #else:
        for obj in self.object:
            #rs.SetUserText(obj,"ObjectType",templates[self.rGroup.SelectedIndex].name)
            #print len(templates[self.rGroup.SelectedIndex].attributes)
            #print len(self.layoutAttributeTextBox)
            for (attr,textBox) in zip(self.m_attributeLabels,self.m_attributeTextboxes):
                rs.SetUserText(obj,"Attribute."+attr.Text,textBox.Text)
            for (act,textBox) in zip(self.m_activityLabels,self.m_activityTextboxes):
                rs.SetUserText(obj,"Activity."+act.Text,textBox.Text)
        self.Close(True)
        
class AgentPropertiesDialog(forms.Dialog[bool]):
    # Dialog box Class initializer
    def __init__(self,obj):
        self.object = obj
        self.Title = "Agent Properties"
        self.layout = forms.DynamicLayout()
        self.layout.Spacing = drawing.Size(5, 5)
        self.layout.Padding = drawing.Padding(10)
        self.layout.AddRow(forms.Label(Text = "There will be agent properties here"))
        self.layout.AddSpace()
        # Create the default button
        self.DefaultButton = forms.Button(Text = 'OK')
        self.DefaultButton.Click += self.OnOKButtonClick
        self.layout.AddRow(None,self.DefaultButton)
        
        self.Content = self.layout
        
    
    # OK button click handler
    def OnOKButtonClick(self, sender, e):
        #if self.m_textbox.Text == "":
            #self.Close(False)
        #else:
        self.Close(True)
        
class MyComponent(component):
    def __init__(self):
        self.selectedObject = None
        self.isAgentSelected = False
        #self.templates = []
    
    def LoadTemplateCSV(self,filename):
        if not filename:
            return
        with open(filename) as csvfile:
            reader = csv.reader(csvfile)
            newTemplate = False
            attributeSession = False
            activitySession = False
            curTemplate = None
            attributeCount = 0
            global maxAttributes
            for row in reader:
                if row[0] == "Object":
                    attributeCount = 0
                    curTemplate = ObjectTemplate(row[1])
                    newTemplate = True
                elif row[0] == "Type":
                    attributeSession = (row[1] == "Attributes")
                    activitySession = (row[1] == "Activity")
                elif row[0] == "EndObject":
                    newTemplate = False
                    attributeSession = False
                    activitySession = False
                    templates.append(curTemplate)
                    maxAttributes = max(maxAttributes,attributeCount)
                    #curTemplate = None
                elif attributeSession:
                    curTemplate.AddAttribute(row[0],row[1])
                    attributeCount += 1
                elif activitySession:
                    curTemplate.AddActivity(row[0],row[1])
                    
    def RunScript(self, counter,reset):
        if reset:
            return False
        """Provides a scripting component.
            Inputs:
                x: The x script variable
                y: The y script variable
            Output:
                a: The a output variable"""
        
        __author__ = "andri.setiawan"
        __version__ = "2020.05.03"
        anySelected = False
        if len(templates) == 0:
            cFPath = ghenv.Component.OnPingDocument().FilePath
            cpath = cFPath[0:cFPath.rfind('\\')+1]
            my_path = cpath+'..\\res\\templates.csv'
            self.LoadTemplateCSV(my_path)
            
            
        
        sc.doc = rh.RhinoDoc.ActiveDoc
        #rh.DocObjects.Tables.ObjectTable.
        objList = rh.DocObjects.Tables.ObjectTable.GetSelectedObjects(sc.doc.Objects,False,False)
        sc.doc=ghdoc
        
        #print objList
        firstObject = None
        
        objectSelection = []
        keepGroup = []
        keepObject = []
        for i,obj in enumerate(objList):
            if i == 0:
                firstObject = obj
                keepGroup = firstObject.Attributes.GetGroupList()
            #if i == 0:
                #firstObject = obj
                #usrData = rs.GetUserText(obj)
                #dialog = AttributeDialog(obj)
                #rc = dialog.ShowModal(Rhino.UI.RhinoEtoApp.MainWindow)
                #self.selectedObject = obj
            #break
            else:
                objectSelection.append(obj)
            
            
        keepObject.append(firstObject)
        
        if keepGroup != None and len(keepGroup) != 0:
            for groupId in keepGroup:
                for obj in objectSelection:
                    objGroup = obj.Attributes.GetGroupList()
                    if objGroup != None and groupId in objGroup:
                        keepObject.append(obj)
            
        if firstObject:
            if self.selectedObject != firstObject:
                userData = rs.GetUserText(firstObject)
                print "usera"
                print userData
                hasTemplateData = False
                if len(userData) > 0:
                    hasTemplateData = ("ObjectType" in userData)
                #print hasTempla
                if hasTemplateData:
                    dialog = AttributeDialog(keepObject)
                elif ("LiveAgent" in userData):
                    dialog = AgentPropertiesDialog(firstObject)
                    self.isAgentSelected = True
                else:
                    dialog = SelectTemplateDialog(keepObject)
                rc = dialog.ShowModal(Rhino.UI.RhinoEtoApp.MainWindow)
                self.selectedObject = firstObject
        else:
            self.selectedObject = None
            self.isAgentSelected = False
        #Rhino.DocObjects.CurveObject.I
        if firstObject:
            rh.DocObjects.Tables.ObjectTable.UnselectAll(rh.RhinoDoc.ActiveDoc.Objects)
            #for obj in keepObject:
                #rh.DocObjects.Tables.ObjectTable.Select(rh.RhinoDoc.ActiveDoc.Objects,obj.Id,True,True)
        anySelected = (firstObject != None) and not self.isAgentSelected
        # return outputs if you have them; here I try it for you:
        return anySelected
# ---------- end checkselectedobject ----------
# ---- group: Agent Processor
agentupdater = GhPythonScript(
    checkAgent=checkagent,
    anySelected=checkselectedobject,
    mArea=gridgenerator.gridArea,
    agent=agentgenerator,
    topPos=gridgenerator.topPos,
    additionalWeight=gridgenerator.additionalWeight,
    boundArea=python_3.area,
    deltaTime=c_script.deltaTime,
    scaleSpeed=Slider(4, range=0.5..4))  # -> agentList, a, angle, dirs, floors, objectInView; inputs checkAgent: Boolean, mArea: list, agent: list, topPos: list of Point3d, additionalWeight: list, boundArea: list
# ---------- agentupdater: Python ----------
from ghpythonlib.componentbase import executingcomponent as component
import Grasshopper, GhPython
import System
import Rhino
import rhinoscriptsyntax as rs
import sys
from Rhino.Geometry import Point3d,Vector3f,Vector3d,Line,Polyline
import math
import scriptcontext as sc

import time

cFPath = ghenv.Component.OnPingDocument().FilePath
cpath = cFPath[0:cFPath.rfind('\\')+1]
my_path = cpath+'..\source'
if not my_path in sys.path:
    sys.path.append(my_path)

import Agent
Agent = reload(Agent)

import PathFinding
PathFinding = reload(PathFinding)

import Global

class MyComponent(component):
    def __init__(self):
        self.haveAgentList = False
        self.myAgent = None
        self.s = 0
        self.pointScreen = []
        self.m_lastReport = 0
        self.m_frameCount = 0
        self.m_frameEndCount = 0
        self.m_lastTime = 0
    
    def RunScript(self,checkAgent, anySelected,mArea, agent,topPos,additionalWeight,boundArea,deltaTime, scaleSpeed):
        self.TimeLogStart()
        timeRS1 = int(time.time()*1000)
        import Agent
        
        PathFinding.Map.topPos = topPos
        PathFinding.Map.additionalWeight = additionalWeight
        angle = []
        
        self.ProfileTime("Prepare")
        #there is no agent
        if not agent[0]:
            self.pointScreen = []
            self.myAgent = []
            PathFinding.Map.liveBlock = []
            self.m_frameCount = 0
            self.m_frameEndCount = 0
            self.ProfileTime("Inactive")
            return
        elif len(self.pointScreen) == 0:
            for i in range(len(agent)):
                point = Point3d(0,0,0)
                self.pointScreen.append(point)
                PathFinding.Map.liveBlock.append(((0,0),0))
            self.ProfileTime("Block")
        a = None
        Agent.Agent.s_scaleSpeed = scaleSpeed
        """Provides a scripting component.
            Inputs:
                x: The x script variable
                y: The y script variable
            Output:
                a: The a output variable"""
        if self.m_frameEndCount != self.m_frameCount:
            Global.Logger.LogDebug("Problem at frame "+str(self.m_frameEndCount)+"\n")
            self.m_frameEndCount = self.m_frameCount
        self.m_frameCount += 1
        Global.Logger.LogDebug("Starting frame "+str(self.m_frameCount)+"\n")
        Agent.Agent.agentList = agent
        if not self.myAgent:
            self.myAgent = agent
            Agent.Agent.s_possibleTarget = sc.sticky["PossibleTarget"]
            Agent.Agent.s_entryPointList = sc.sticky["EntryPoint"]
            sc.sticky["StartFrame"] = int(time.time()*1000)
            deltaTime = 0
            Agent.LoadSocialization()
            self.ProfileTime("Load")
        PathFinding.Map.maze = mArea
        
        __author__ = "andri.setiawan"
        __version__ = "2020.03.21"
        
        import rhinoscriptsyntax as rs
        
        #Agent.Agent.s_possibleTarget = possibleTarget
        #Agent.Agent.s_entryPointList = entryPoints
        
        vectorDir = []
        floorList = []
        objectInView = []
        #print "aa "+str(deltaTime)
        Global.g_timer.Update(deltaTime)
        Global.g_myHouse.UpdateHouse()
        Global.Logger.LogDebug("CurTime = "+Global.g_timer.GetFormattedHour()+"\n")
        print Global.g_timer.GetFormattedHour()
        curHour = Global.g_timer.GetHour()
        self.ProfileTime("House/Timer")
        if curHour != self.m_lastReport:
            self.m_lastReport = curHour
            Global.Logger.LogDebug("Call for report\nResource:\n")
            Global.g_myHouse.ReportResource()
            Global.Logger.LogDebug("Energy Usage:\n")
            Global.g_myHouse.ReportEnergyUsage()
            self.ProfileTime("HourlyReport")
        for (i,agt) in enumerate(self.myAgent):            
            if not checkAgent:
                #print "ini "+str(i)
                timeRS12 = int(time.time()*1000)
                pos = agt.Update(deltaTime)
                timeRS22 = int(time.time()*1000)
                print "update ag "+agt.m_role+" "+str(timeRS22 - timeRS12)
                #print "cc "+str(agt.waitTime)
                #agt.setBoundArea(boundArea[agt.m_myFloorIndex])
                #self.UpdateViewAgent(agt)
            
                #if len(PathFinding.Map.liveBlock) <= i:
                #    PathFinding.Map.liveBlock.append((Agent.TranslateToGridPos(pos,agt.m_myFloorIndex),agt.m_myFloorIndex))
                #else:
                #    PathFinding.Map.liveBlock[i] = (Agent.TranslateToGridPos(pos,agt.m_myFloorIndex),agt.m_myFloorIndex)
                
                self.pointScreen[i].X = pos.X
                self.pointScreen[i].Y = pos.Y
                self.pointScreen[i].Z = pos.Z
            
            angle.append(math.atan2(agt.moveDir.Y,agt.moveDir.X) - math.atan2(-1,0))
            vectorDir.append(agt.moveDir)
            floorList.append(agt.m_myFloorIndex)
            objectInView.append(agt.m_currentRoom.m_object)
            
        self.ProfileTime("AgentUpdate")
        print("nomura "+str("NumberOfDays" in sc.sticky)+" "+str(Global.g_timer.m_time))
        print("run frame "+str(self.m_frameCount))
        if "NumberOfDays" in sc.sticky:
            print("daimu "+str(Global.g_timer.GetDay())+" "+str(sc.sticky["NumberOfDays"]))
        if "NumberOfDays" in sc.sticky and Global.g_timer.GetDay() == sc.sticky["NumberOfDays"]:
            Global.g_myHouse.ExportEnergyUsageReport()
            sc.sticky["AgentActivationDone"] = False
            Global.Logger.LogDebug("fakboi")
            Global.Logger.DumpDebug()
            for agent in self.myAgent:
                agent.WriteBioReport()
            self.ProfileTime("EndReport")
        # return outputs if you have them; here I try it for you:
        a = self.pointScreen
        timeRS2 = int(time.time()*1000)
        print str(timeRS2 - sc.sticky["StartFrame"])
        print str(timeRS2 - timeRS1)
        self.m_frameEndCount += 1
        Global.Logger.LogDebug("End frame "+str(self.m_frameEndCount)+"\n")
        print("agasu "+str(len(self.myAgent)))
        self.ProfileTime("EndFrame")
        return self.myAgent,a,angle,vectorDir,floorList,objectInView
        
    def UpdateViewAgent(self,agent):
        t1 = int(time.time()*1000)
        curveBound = agent.curveBoundArea#rs.coercecurve(agent.boundArea)
        #rc,pl = curveBound.TryGetPolyline()
        
        diagL = agent.diagonalBound#Vector3d.Subtract(Vector3d(curveBound.Points[0].Location),Vector3d(curveBound.Points[2].Location)).Length
        
        #curveBound,diagL = agent.getBoundArea()
        
        vec1 = rs.VectorRotate(agent.moveDir,-60,(0,0,1))
        #vec1.Unitize()
        endl1 = Point3d.Add(agent.pos,(vec1*diagL))
        mLine1 = Line(agent.pos,endl1)
        
        vec2 = rs.VectorRotate(agent.moveDir,60,(0,0,1))
        #vec2.Unitize()
        endl2 = Point3d.Add(agent.pos,(vec2*diagL))
        mLine2 = Line(agent.pos,endl2)
        
        iSect1 = Rhino.Geometry.Intersect.Intersection.CurveCurve(curveBound,mLine1.ToNurbsCurve(),0,0)
        iSect2 = Rhino.Geometry.Intersect.Intersection.CurveCurve(curveBound,mLine2.ToNurbsCurve(),0,0)
        #print "line1 "+str(mLine1.From)+" "+str(mLine1.To)
        #print "line2 "+str(mLine2.From)+" "+str(mLine2.To)
        
        for inte in iSect1:
            point1 = inte.PointA
            
        for inte in iSect2:
            point2 = inte.PointA
            
        
        vpointList = []
        for poin in curveBound.Points:
            vect = Vector3d.Subtract(Vector3d(poin.Location),Vector3d(agent.pos))
            vect.Unitize()
            angle = math.degrees(math.atan2(vect.Y,vect.X)-math.atan2(vec1.Y,vec1.X))
            if angle >= 0 and angle <= 120:
                vpointList.append((vect,poin.Location))
        
        vpointList.sort(key = lambda x: math.degrees(math.atan2(x[0].Y,x[0].X)-math.atan2(vec1.Y,vec1.X)),reverse = True)
        
        #print vpointList
        pointList = []
        pointList.append(agent.pos)
        pointList.append(point2)
        for vpoint in vpointList:
            pointList.append(vpoint[1])
        pointList.append(point1)
        pointList.append(agent.pos)
        palo = Polyline(pointList)
        
        t2 = int(time.time()*1000)
        print "delta1 "+str(t2-t1)
        view = sc.doc.Views.ActiveView.ActiveViewport      
        agent.objectList = Rhino.RhinoDoc.ActiveDoc.Objects.FindByCrossingWindowRegion(view,palo,True,Rhino.DocObjects.ObjectType.InstanceReference)
        #print agent.objectList
        t3 = int(time.time()*1000)
        print "delta2 "+str(t3-t2)
    
    def TimeLogStart(self):
        self.m_lastTime = int(time.time()*1000)
        
    def ProfileTime(self, part):
        curTime = int(time.time()*1000)
        print("Profile "+part+" "+str(curTime - self.m_lastTime))
        self.m_lastTime = curTime

def TranslateToGridPos(topPos,pos):
    gridX = int(math.ceil((pos.X - topPos.X)/0.1))
    gridY = int(math.ceil((topPos.Y - pos.Y)/0.1))
    return gridX,gridY
# ---------- end agentupdater ----------
agentviewupdater = CSharpScript(
    Rect=python_3.area,
    Pos=agentupdater.a,
    Floor=agentupdater.floors,
    Dir=agentupdater.dirs,
    ActiveAgent=python_4.ActiveAgent)  # -> out, objectInView; inputs Rect: list of Rectangle3d, Pos: list of Point3d, Floor: list of Int32, Dir: list of Vector3d, ActiveAgent: list of Boolean; disabled
# ---------- agentviewupdater: C# usings ----------
using Rhino.DocObjects;
using System.Linq;
# ---------- agentviewupdater: C# ----------
    //Rhino.RhinoDoc.ActiveDoc.Views.ActiveView
    Print(lastError);
    var ll = Rhino.RhinoDoc.ActiveDoc.Layers.FindByFullPath("ARS-Dinding", -1);
    Print("dene " + ll);
    if(!isInitialized)
    {
      
      //foreach 
      int wallLayerIdx = Rhino.RhinoDoc.ActiveDoc.Layers.FindByFullPath("ARS-Dinding", -1);
      foreach(Rectangle3d rct in Rect)
      {
        Polyline pl = rct.ToPolyline();
        List<Rhino.DocObjects.RhinoObject> wList = Rhino.RhinoDoc.ActiveDoc.Objects.FindByCrossingWindowRegion(Rhino.RhinoDoc.ActiveDoc.Views.ActiveView.ActiveViewport, pl, true, Rhino.DocObjects.ObjectType.Curve).Where(elm => elm.Attributes.LayerIndex == wallLayerIdx).ToList();
        wallList.Add(wList);
        List<Rhino.Geometry.Curve> wListCurve = new List<Rhino.Geometry.Curve>();
        foreach(Rhino.DocObjects.RhinoObject wall in wList)
        {
          wListCurve.Add(((Rhino.DocObjects.CurveObject) wall).CurveGeometry);
        }
        wallListCurve.Add(wListCurve);
        diagL.Add(Point3d.Subtract(pl.ElementAt(0), pl.ElementAt(2)).Length);
        rectCurve.Add(pl.ToPolylineCurve());
        rectArea.Add(pl);
      }
      isInitialized = true;
    }
    Print("onoy " + isInitialized);
    objectInViewField.Clear();
    //ro.
    //RhinoObject r;
    //r.
    DateTime t1 = DateTime.Now;
    //myDir.Rotate(RhinoMath.ToRadians(-90), Vector3d.ZAxis);

    for(int i = 0;i < Dir.Count;i++)
    {
      if(!ActiveAgent.ElementAt(i))
      {
        objectInViewField.Add(new List<Rhino.DocObjects.RhinoObject>());
        continue;
      }

      Vector3d tmp = new Vector3d(Dir.ElementAt(i));
      tmp.Rotate(RhinoMath.ToRadians(-60), Vector3d.ZAxis);
      Line l1 = new Line(Pos[i], tmp, diagL[Floor[i]]);

      tmp.Rotate(RhinoMath.ToRadians(120), Vector3d.ZAxis);
      Line l2 = new Line(Pos[i], tmp, diagL[Floor[i]]);

      tmp.Rotate(RhinoMath.ToRadians(-120), Vector3d.ZAxis);

      Rhino.Geometry.PolylineCurve curFloorArea = rectCurve.ElementAt(Floor[i]);
      Rhino.Geometry.Polyline curFloorPl = rectArea.ElementAt(Floor[i]);
      var iSect = Rhino.Geometry.Intersect.Intersection.CurveCurve(curFloorArea, l1.ToNurbsCurve(), 0, 0);
      Point3d point1 = new Point3d(0, 0, 0);
      for(int j = 0;j < iSect.Count;j++)
      {
        point1 = iSect.ElementAt(j).PointA;
      }
      //Print("puki " + point1);
      iSect = Rhino.Geometry.Intersect.Intersection.CurveCurve(curFloorArea, l2.ToNurbsCurve(), 0, 0);
      Point3d point2 = new Point3d(0, 0, 0);
      for(int j = 0;j < iSect.Count;j++)
      {
        point2 = iSect.ElementAt(j).PointA;
      }

      List<Point3d> pointList = new List<Point3d>();
      List<Tuple<Point3d,double>> vpointList = new List<Tuple<Point3d,double>>();
      for(int j = 0;j < curFloorPl.Count - 1;j++)
      {
        Vector3d dir = Point3d.Subtract(curFloorPl.ElementAt(j), Pos[i]);
        dir.Unitize();
        double angle = RhinoMath.ToDegrees(Math.Atan2(dir.Y, dir.X) - Math.Atan2(tmp.Y, tmp.X));
        //Print("elus " + angle);
        if(angle >= 0 && angle <= 120)
        {
          vpointList.Add(Tuple.Create(curFloorPl.ElementAt(j), angle));
        }
        //pointList
      }

      vpointList = vpointList.OrderByDescending(elm => elm.Item2).ToList();
      pointList.Add(Pos[i]);
      pointList.Add(point2);
      for(int j = 0;j < vpointList.Count();j++)
      {
        pointList.Add(vpointList.ElementAt(j).Item1);
      }
      pointList.Add(point1);
      pointList.Add(Pos[i]);

      Polyline viewArea = new Polyline(pointList);
      PolylineCurve viewAreaCurve = viewArea.ToPolylineCurve();

      List<Rhino.Geometry.Curve> checkWallList = new List<Rhino.Geometry.Curve>(wallListCurve[Floor[i]]);
      List<Tuple<Point3d,Point3d,double,double>> pointToConsiderate = new List<Tuple<Point3d,Point3d,double,double>>();

      Vector3d vDir = new Vector3d(tmp);
      Tuple<Point3d,Point3d,double,double> tmpTuple;
      int looper = 0;
      int AddWall = 0;
      int oriWall = checkWallList.Count();
      int loop = 0;
      String lastWall = "";
      while(checkWallList.Count() > 0)
      {
        looper += 1;
        if(looper > 1000)
        {
          lastError = "Wall ono error: ori " + oriWall + " addw " + AddWall + " lastloop " + loop + " " + lastWall;
          return;
        }
        Rhino.Geometry.Curve curWall = checkWallList.ElementAt(0);
        checkWallList.RemoveAt(0);
        iSect = Rhino.Geometry.Intersect.Intersection.CurveCurve(viewAreaCurve, curWall, 0, 0);

        pointToConsiderate.Clear();
        foreach (Rhino.Geometry.Intersect.IntersectionEvent sect in iSect)
        {
          double posPointC;
          viewAreaCurve.ClosestPoint(sect.PointA, out posPointC);
          double posPointW;
          curWall.ClosestPoint(sect.PointA, out posPointW);
          double testPos = Math.Round(posPointW) - posPointW;
          if(Math.Abs(testPos) > 0.05)
          {
            pointToConsiderate.Add(Tuple.Create(sect.PointA, sect.PointA, posPointC, posPointW));
          }
        }
        Polyline pll;
        curWall.TryGetPolyline(out pll);

        foreach(Point3d p in pll)
        {
          vDir = Point3d.Subtract(p, Pos[i]);
          double angle = RhinoMath.ToDegrees(Vector3d.VectorAngle(vDir, Dir[i]));
          if(angle > 60)
          {
            continue;
          }
          Rhino.Geometry.PointContainment pointPos = viewAreaCurve.Contains(p);
          //Print("peplos " + pointPos);
          if(pointPos == Rhino.Geometry.PointContainment.Inside)
          {
            Line line = new Line(Pos[i], vDir, diagL[Floor[i]]);
            iSect = Rhino.Geometry.Intersect.Intersection.CurveCurve(viewAreaCurve, line.ToNurbsCurve(), 0, 0);
            foreach (Rhino.Geometry.Intersect.IntersectionEvent sect in iSect)
            {
              if(!sect.PointA.Equals(Pos[i]))
              {
                double posPointC;
                viewAreaCurve.ClosestPoint(sect.PointA, out posPointC);
                double posPointW;
                curWall.ClosestPoint(p, out posPointW);
                //Print("penpendar ");
                pointToConsiderate.Add(Tuple.Create(p, sect.PointA, posPointC, posPointW));
                //Print("perotak "+pointToConsiderate.Count());
              }
            }
          }
          else if(pointPos == Rhino.Geometry.PointContainment.Coincident)
          {
            double posPointC;
            viewAreaCurve.ClosestPoint(p, out posPointC);
            double posPointW;
            curWall.ClosestPoint(p, out posPointW);
            pointToConsiderate.Add(Tuple.Create(p, p, posPointC, posPointW));
          }
          else if(iSect.Count == 0)
          {
            break;
          }
        }
        //Print("samkara " + pointToConsiderate.Count());
        if(pointToConsiderate.Count > 2)
        {
          pointToConsiderate = pointToConsiderate.OrderBy(elm => elm.Item4).ToList();
          //Print();
          loop = 0;
          while(pointToConsiderate.Count() > 1)
          {
            loop += 1;
            if(loop > 100)
            {
              lastError = "Point error";
              return;
            }
            var curElm = pointToConsiderate.ElementAt(0);
            pointToConsiderate.RemoveAt(0);
            //Print("remkaliii");
            var nextElm = pointToConsiderate.ElementAt(0);
            if(!nextElm.Item1.Equals(curElm.Item1))
            {
              Line newWall = new Line(curElm.Item1, nextElm.Item1);
              checkWallList.Add(newWall.ToNurbsCurve());
            }
            AddWall += 1;
            lastWall = "wall " + curElm.Item1 + " to " + nextElm.Item1;
            if(nextElm.Item1.Equals(nextElm.Item2))
            {
              pointToConsiderate.RemoveAt(0);
            }
            else if(pointToConsiderate.Count > 1 && Math.Abs(((int) pointToConsiderate.ElementAt(1).Item3) - ((int) nextElm.Item3)) > 1)
            {
              pointToConsiderate.RemoveAt(0);
            }
          }
        }
        else if(pointToConsiderate.Count == 2)
        {
          pointToConsiderate = pointToConsiderate.OrderBy(elm => elm.Item3).ToList();
          tmpTuple = pointToConsiderate.ElementAt(1);
          pointList.Insert((int) (tmpTuple.Item3 + 1), tmpTuple.Item2);
          if(!tmpTuple.Item1.Equals(tmpTuple.Item2))
          {
            pointList.Insert((int) (tmpTuple.Item3 + 1), tmpTuple.Item1);
          }
          int idxToRemove = (int) (tmpTuple.Item3);
          tmpTuple = pointToConsiderate.ElementAt(0);
          pointList.RemoveRange((int) (tmpTuple.Item3 + 1), idxToRemove - (int) (tmpTuple.Item3));
          if(!pointList.ElementAt((int) tmpTuple.Item3).Equals(tmpTuple.Item1))
          {
            pointList.Insert((int) (tmpTuple.Item3 + 1), tmpTuple.Item1);
          }
          if(!tmpTuple.Item1.Equals(tmpTuple.Item2))
          {
            pointList.Insert((int) (tmpTuple.Item3 + 1), tmpTuple.Item2);
          }
          pointList = pointList.Distinct().ToList();
          pointList.Add(Pos[i]);
          viewArea = new Polyline(pointList);
          viewAreaCurve = viewArea.ToPolylineCurve();
        }
        //Print("sekot " + iSect.Count);

      }
      objectInViewField.Add(Rhino.RhinoDoc.ActiveDoc.Objects.FindByCrossingWindowRegion(Rhino.RhinoDoc.ActiveDoc.Views.ActiveView.ActiveViewport, viewArea, true, Rhino.DocObjects.ObjectType.InstanceReference).ToList());//.Where(elm => elm.Attributes.LayerIndex == 98).ToList();
    }
    objectInView = objectInViewField;


    DateTime t2 = DateTime.Now;
    TimeSpan ts = t2 - t1;
    Print("tossua " + ts.TotalMilliseconds);
    //foreach(Point3d pph in pointList)
    //{
    //Print("polit " + pph);
    //}
    //Print("cudat "+DateTime.UtcNow);
    //pointList.
    //ro.
    //RhinoObject[] allWall = Rhino.RhinoDoc.ActiveDoc.Objects.FindByLayer("ARS-DINDING");
    //Rhino.RhinoApp.WriteLine("asu");
    //Print("kampret");
    //for(int i = 0;i < ro.Length;i++)
    //for(int i = 0;i < ro.Count();i++)
    //{
    //Rhino.RhinoApp.WriteLine("ojek " + ro[i]);
    //Console.WriteLine("ojek " + ro[i]);
    //Print("ojek " + ro[i].Id+" "+ro[i].Attributes.LayerIndex);
    //Print("ojek " + ro.ElementAt(i).Id);
    //}
# ---------- agentviewupdater: C# additional code ----------
  bool isInitialized = false;
  List<List<Rhino.DocObjects.RhinoObject>> wallList = new List<List<Rhino.DocObjects.RhinoObject>>();
  List<List<Rhino.Geometry.Curve>> wallListCurve = new List<List<Rhino.Geometry.Curve>>();
  List<double> diagL = new List<double>();
  List<Rhino.Geometry.PolylineCurve> rectCurve = new List<Rhino.Geometry.PolylineCurve>();
  List<Rhino.Geometry.Polyline> rectArea = new List<Rhino.Geometry.Polyline>();
  List<List<Rhino.DocObjects.RhinoObject>> objectInViewField = new List<List<Rhino.DocObjects.RhinoObject>>();
  String lastError = "No error";
# ---------- end agentviewupdater ----------

# ----
panel_2 = Panel(agentviewupdater.out)
python_5 = GhPythonScript(x=agentviewupdater.objectInView)  # -> a; inputs x: list; disabled
# ---------- python_5: Python ----------
from ghpythonlib.componentbase import executingcomponent as component
import Grasshopper, GhPython
import System
import Rhino
import rhinoscriptsyntax as rs
import scriptcontext as sc

class MyComponent(component):
    
    def RunScript(self, x, y):
        """Provides a scripting component.
            Inputs:
                x: The x script variable
                y: The y script variable
            Output:
                a: The a output variable"""
        
        __author__ = "remote"
        __version__ = "2020.07.13"
        
        import rhinoscriptsyntax as rs
        sc.doc = Rhino.RhinoDoc.ActiveDoc
        for ct in x:
            for ctt in ct:
                print "onkela "+str(ctt.Id)
                print rs.BlockInstanceName(ctt.Id)
                
        sc.doc = ghdoc
            #print "nitemiaaa"
        # return outputs if you have them; here I try it for you:
        return None
# ---------- end python_5 ----------

# ---- group: Information Display (continued)
python_6 = GhPythonScript(checkAgent=checkagent, agentList=agentupdater.agentList, location=agentupdater.a, angle=agentupdater.angle)  # -> a; inputs agentList: list, location: list of Point3d, angle: list
# ---------- python_6: Python ----------
from ghpythonlib.componentbase import executingcomponent as component
import Grasshopper, GhPython
import System
import Rhino
import rhinoscriptsyntax as rs
import scriptcontext as sc
from Rhino.Geometry import Plane,NurbsSurface,Point3d,Vector3d
import sys

cFPath = ghenv.Component.OnPingDocument().FilePath
print cFPath
cpath = cFPath[0:cFPath.rfind('\\')+1]
print cpath
my_path = cpath+'..\source'
if not my_path in sys.path:
    sys.path.append(my_path)

import Agent
Agent = reload(Agent)

class MyComponent(component):
    def __init__(self):
        self.isAgentBaked = False
        self.magel = []
        self.gugu = []
    
    def RunScript(self, checkAgent, agentList,location, angle):
        """Provides a scripting component.
            Inputs:
                x: The x script variable
                y: The y script variable
            Output:
                a: The a output variable"""
        
        __author__ = "andri.setiawan"
        __version__ = "2020.05.12"
        
        import rhinoscriptsyntax as rs
        
        halfSize = 0.3
        fullSize = halfSize*2
        if checkAgent:
            if not self.isAgentBaked:
                
                sc.doc = Rhino.RhinoDoc.ActiveDoc
                for (loc,agl) in zip(location,angle):
                    #loc = agent.pos
                    sf = NurbsSurface.CreateFromCorners(Point3d(loc.X - fullSize,loc.Y-fullSize,0),Point3d(loc.X,loc.Y-fullSize,0),Point3d(loc.X,loc.Y,0),Point3d(loc.X - fullSize,loc.Y,0))
                    #sf = NurbsSurface.CreateFromCorners(Point3d(loc.X - halfSize,loc.Y-halfSize,0),Point3d(loc.X+halfSize,loc.Y-halfSize,0),Point3d(loc.X+halfSize,loc.Y+halfSize,0),Point3d(loc.X - halfSize,loc.Y+halfSize,0))
                    sf.Rotate(agl,Vector3d(0,0,1),loc)
                    print agl
                    self.magel.append(agl)
                    plane = None
                    rc,plane = sf.TryGetPlane(0)
                    #Rhino.RhinoDoc.ActiveDoc.Objects.AddPictureFrame(
                    #sc.doc.Objects.AddSurface(sf)
                    guid = sc.doc.Objects.AddPictureFrame(plane,"D:\Project\omae\walki.png",True,halfSize*2,halfSize*2,False,True)
                    rs.SetUserText(guid,"LiveAgent","--")
                    self.gugu.append(guid)
                self.isAgentBaked = True
                sc.doc = ghdoc
        else:
            if self.isAgentBaked:
                self.isAgentBaked = False
        for agl in self.magel:
            print agl
        for gu in self.gugu:
            print gu
        # return outputs if you have them; here I try it for you:
        return None
# ---------- end python_6 ----------
python_7 = GhPythonScript(agentList=agentupdater.agentList, frame=c_script.deltaTime, reset=python, objectInView=agentupdater.objectInView)  # -> a; inputs agentList: list, reset: Boolean, objectInView: list; disabled
# ---------- python_7: Python ----------
from ghpythonlib.componentbase import executingcomponent as component
import Grasshopper, GhPython
import System
import Rhino as rh
import rhinoscriptsyntax as rs
import scriptcontext as sc
import sys
import time

import System
import Rhino.UI
import Eto.Drawing as drawing
import Eto.Forms as forms

cFPath = ghenv.Component.OnPingDocument().FilePath
cpath = cFPath[0:cFPath.rfind('\\')+1]
my_path = cpath+'..\source'
if not my_path in sys.path:
    sys.path.append(my_path)
    
import Agent
#Agent = reload(Agent)

import HomeObject
HomeObject = reload(HomeObject)

class AgentInfo(forms.Form):
    def __init__(self):
        self.myAgent = None
        
        self.Title = "Agent Info"
        self.Padding = drawing.Padding(10)
        
        self.layout = forms.DynamicLayout()
        self.layout.Spacing = drawing.Size(5,5)
        self.layout.Padding = drawing.Padding(10)
        
        nLabel = forms.Label()
        
        self.layout.AddRow(nLabel)
        
        self.Content = self.layout
    
    def SetAgent(self,agent):
        self.myAgent = agent
        
    def UpdateForm(self):
        layout = forms.DynamicLayout()
        layout.Spacing = drawing.Size(5,5)
        layout.Padding = drawing.Padding(10)
        
        nLabel = forms.Label(Text = str(self.myAgent.pos))
        
        sc.doc = rh.RhinoDoc.ActiveDoc
        
        for obj in self.myAgent.objectList:
            objectFound = False
            #print len(HomeObject.HomeObject.HomeObjectList)
            for hObject in HomeObject.HomeObject.HomeObjectList:
                #print hObject
                if hObject.IsPartFromThis(obj):
                    objectFound = True
                    break
            displayText = rs.BlockInstanceName(obj.Id)
            if objectFound and hObject.HasTarget():
                amountOccupied,amountTarget = hObject.Occupied()
                if amountTarget == 1:
                    if amountOccupied != 0:
                        displayText += " : OCCUPIED"
                    else:
                        displayText += " : FREE"
                else:
                    if amountTarget == amountOccupied:
                        displayText += (" : FULL CAPACITY "+str(amountOccupied)+"/"+str(amountTarget))
                    else:
                        displayText += (" : "+str(amountTarget - amountOccupied)+" AVAILABLE FROM "+str(amountTarget)+" SPACE")
            nLabel = forms.Label(Text = displayText)
            layout.AddRow(nLabel)
        sc.doc = ghdoc
        #layout.AddRow(nLabel)
        self.Content = layout

class MyComponent(component):
    def __init__(self):
        self.myAgentInfo = []
        self.formCreated = False
        self.formShow = False
        
    def ShowForm(self):
        for agentInfo in self.myAgentInfo:
            agentInfo.Show()
        self.formShow = True
    
    def InitForm(self,agents):
        print "Call init form"
        for agent in agents:
            if agent.m_active:
                agentInfo = AgentInfo()
                agentInfo.SetAgent(agent)
                agentInfo.UpdateForm()
                self.myAgentInfo.append(agentInfo)
        #ferom = forms.Form()
        print("golad "+str(len(self.myAgentInfo)))
        self.formCreated = True
        
    def UpdateForm(self,agent):
        layout = forms.DynamicLayout()
        layout.Spacing = drawing.Size(5,5)
        layout.Padding = drawing.Padding(10)
        
        if agent == None or len(agent) == 0 or agent[1] == None:
            nLabel = forms.Label(Text = "No Agent")
            layout.AddRow(nLabel)
        else:
            nLabel = forms.Label(Text = str(agent[1].pos))
            
            sc.doc = rh.RhinoDoc.ActiveDoc
        
            for obj in agent[1].objectList:
                objectFound = False
                #print len(HomeObject.HomeObject.HomeObjectList)
                for hObject in HomeObject.HomeObject.HomeObjectList:
                    print hObject
                    if hObject.IsPartFromThis(obj):
                        objectFound = True
                        break
                displayText = rs.BlockInstanceName(obj.Id)
                if hObject.HasTarget():
                    amountOccupied,amountTarget = hObject.Occupied()
                    if amountTarget == 1:
                        if amountOccupied != 0:
                            displayText += " : OCCUPIED"
                        else:
                            displayText += " : FREE"
                    else:
                        if amountTarget == amountOccupied:
                            displayText += (" : FULL CAPACITY "+str(amountOccupied)+"/"+str(amountTarget))
                        else:
                            displayText += (" : "+str(amountTarget - amountOccupied)+" AVAILABLE FROM "+str(amountTarget)+" SPACE")
                nLabel = forms.Label(Text = displayText)
                layout.AddRow(nLabel)
            sc.doc = ghdoc
        #layout.AddRow(nLabel)
        self.myAgentInfo.Content = layout
    
    def RunScript(self, x, y,reset, objectInView):
        print reset
        if reset:
            self.formCreated = False
            self.formShow = False
            for agentInfo in self.myAgentInfo:
                if agentInfo != None:
                    agentInfo.Close()
            self.myAgentInfo = []
            return None
        """Provides a scripting component.
            Inputs:
                x: The x script variable
                y: The y script variable
            Output:
                a: The a output variable"""
        
        __author__ = "andri.setiawan"
        __version__ = "2020.06.13"
        
        import rhinoscriptsyntax as rs
        
        for (i,agt) in enumerate(x):
            if agt != None:
               agt.objectList = objectInView[i]
        print("karet "+str(self.formCreated))
        if not self.formCreated:
            self.InitForm(x)
        
        #ferom.Show()
        for agentInfo in self.myAgentInfo:
            agentInfo.UpdateForm()
        if not self.formShow:
            self.ShowForm()
        #forms.Form.Sh
        
        # return outputs if you have them; here I try it for you:
        timeRS1 = int(time.time() * 1000)
        print str(timeRS1 - sc.sticky["StartFrame"])
        print("goladoo "+str(len(self.myAgentInfo)))
        return None
# ---------- end python_7 ----------

# ---- group: Anim Processor
animmanager = GhPythonScript(agents=agentupdater.agentList, location=agentupdater.a, angle=agentupdater.angle)  # -> surface, image; inputs agents: list, location: list of Point3d, angle: list
# ---------- animmanager: Python ----------
from ghpythonlib.componentbase import executingcomponent as component
import Grasshopper, GhPython
import System
import Rhino
import rhinoscriptsyntax as rs
import sys
import math
import time
import scriptcontext as sc
from Rhino.Geometry import Surface,Plane,NurbsSurface,Point3d,Vector3d

cFPath = ghenv.Component.OnPingDocument().FilePath
cpath = cFPath[0:cFPath.rfind('\\')+1]
my_path = cpath+'..\source'
if not my_path in sys.path:
    sys.path.append(my_path)

import Agent
Agent = reload(Agent)

class MyComponent(component):
    def __init__(self):
        #cFPath = ghenv.Component.OnPingDocument().FilePath
        #cpath = cFPath[0:cFPath.rfind('\\')+1]
        #self.imgPath = []
        #self.imgPath.append(cpath+'..\\res\\m5.png')
        #self.imgPath.append(cpath+'..\\res\\w1.png')
        #self.imgPath.append(cpath+'..\\res\\m6.png')
        self.m_imgPath = []
        self.m_imgPath.append(cpath+'..\\res\\m5.png')
        self.m_imgPath.append(cpath+'..\\res\\w3.png')
        self.m_imgPath.append(cpath+'..\\res\\m4.png')
        self.m_imgPath.append(cpath+'..\\res\\w2.png')
        self.m_imgPath.append(cpath+'..\\res\\m2.png')
        self.m_imgPath.append(cpath+'..\\res\\w1.png')
        self.m_imgPath.append(cpath+'..\\res\\m6.png')
        self.m_imgPath.append(cpath+'..\\res\\w4.png')
        
    def RunScript(self,agents, location,angle):
        """Provides a scripting component.
            Inputs:
                x: The x script variable
                y: The y script variable
            Output:
                a: The a output variable"""
        
        __author__ = "andri.setiawan"
        __version__ = "2020.05.11"
        
        import rhinoscriptsyntax as rs
        surfaces = []
        imgPath = []
        halfSize = 0.2
        #print location
        for i,agent in enumerate(agents):
            if (agent != None) and (agent.m_active):
                sf = NurbsSurface.CreateFromCorners(Point3d(agent.pos.X - halfSize,agent.pos.Y-halfSize,0),Point3d(agent.pos.X+halfSize,agent.pos.Y-halfSize,0),Point3d(agent.pos.X+halfSize,agent.pos.Y+halfSize,0),Point3d(agent.pos.X - halfSize,agent.pos.Y+halfSize,0))
                angle = math.atan2(agent.moveDir.Y,agent.moveDir.X) - math.atan2(-1,0)
                sf.Rotate(angle,Vector3d(0,0,1),agent.pos)
                surfaces.append(sf)
                imgPath.append(self.m_imgPath[i])
        #for (loc,agl) in zip(location,angle):
            #if loc != None:
                #sf = NurbsSurface.CreateFromCorners(Point3d(loc.X - halfSize,loc.Y-halfSize,0),Point3d(loc.X+halfSize,loc.Y-halfSize,0),Point3d(loc.X+halfSize,loc.Y+halfSize,0),Point3d(loc.X - halfSize,loc.Y+halfSize,0))
                #sf.Rotate(agl,Vector3d(0,0,1),loc)
                #surfaces.append(sf)
        # return outputs if you have them; here I try it for you:
        timeRS2 = int(time.time()* 1000)
        print str(timeRS2 - sc.sticky["StartFrame"])
        return surfaces,imgPath
# ---------- end animmanager ----------
previewmat_2 = CustomPreviewMaterials(Geometry=animmanager.surface, DiffuseColor=RGBA(255, 255, 255, 1), DiffuseBitmap=animmanager.image)
