# Grasshopper definition testintersection.ghx (Grasshopper 1.0.7)

rec = Rectangle({Plane=PlaneXY(7.813427721, 7.457772429, 0), Size=Domain2(u=-8.086810225..8.086810225, v=-7.526684841..7.526684841)})
pt = Point(Point(10.22996343, 5.092820799, 0))
python = GhPythonScript(x=rec, y=pt)  # -> a; inputs y: Point3d
# ---------- python: Python ----------
from ghpythonlib.componentbase import executingcomponent as component
import Grasshopper, GhPython
import System
import Rhino
import rhinoscriptsyntax as rs
from Rhino.Geometry import Point3d,Vector3d

class MyComponent(component):
    
    def RunScript(self, x, y):
        
        """Provides a scripting component.
            Inputs:
                x: The x script variable
                y: The y script variable
            Output:
                a: The a output variable"""
        
        __author__ = "remote"
        __version__ = "2020.05.20"
        
        import rhinoscriptsyntax as rs
        
        rarea = rs.coercecurve(x)
        print rarea.GetType()
        rc,pl = rarea.TryGetPolyline()
        print pl.GetType()
        #Rhino.Geometry.Polyline.
        ad = pl.ToArray()
        print ad
        # return outputs if you have them; here I try it for you:
        return None
# ---------- end python ----------
python_2 = GhPythonScript(x=rec, y=pt)  # -> a; inputs y: Point3d
# ---------- python_2: Python ----------
from ghpythonlib.componentbase import executingcomponent as component
import Grasshopper, GhPython
import System
import Rhino as rh
import rhinoscriptsyntax as rs
import scriptcontext as sc
import Rhino.Geometry
from Rhino.Geometry import Vector3d,Point3d,Line,Polyline
import math
import time

class MyComponent(component):
    def __init__(self):
        self.pola = None
    
    def RunScript(self, x, y):
        """Provides a scripting component.
            Inputs:
                x: The x script variable
                y: The y script variable
            Output:
                a: The a output variable"""
        
        __author__ = "remote"
        __version__ = "2020.05.19"
        
        import rhinoscriptsyntax as rs
        #print x.GetType()
        rarea = rs.coercecurve(x)
        
        #Rhino.Geometry.NurbsCurve.Points
        #Rhino.Geometry.ControlPoint.Location
        #print rarea.Points[0].Location
        #print pl
        rc,pl = rarea.TryGetPolyline()
        view = sc.doc.Views.ActiveView.ActiveViewport      
        objectList = rh.RhinoDoc.ActiveDoc.Objects.FindByCrossingWindowRegion(view,pl,True,rh.DocObjects.ObjectType.Curve)
        sc.doc = rh.RhinoDoc.ActiveDoc
        layerIndex = sc.doc.Layers.Find("ARS_DINDING",True)
        m_wallList = [item.Geometry for item in objectList if item.Attributes.LayerIndex == layerIndex]
        print "wulan "+str(len(m_wallList))
        sc.doc = ghdoc
        
        t1 = int(time.time()*1000000)
        #vecDir = Vector3d(0,1,0)
        vecDir = rs.VectorRotate(Vector3d(0,1,0),-30,(0,0,1))
        diag = Vector3d.Subtract(Vector3d(rarea.Points[0].Location),Vector3d(rarea.Points[2].Location))
        length = diag.Length
        #print diag
        #print len
        #print "abababababababa"
        vec1 = rs.VectorRotate(vecDir,-60,(0,0,1))
        endl1 = Point3d.Add(y,(vec1*length))
        mLine1 = Line(y,endl1)
        
        vec2 = rs.VectorRotate(vecDir,60,(0,0,1))
        endl2 = Point3d.Add(y,(vec2*length))
        mLine2 = Line(y,endl2)
        #Line.to
        iSect1 = Rhino.Geometry.Intersect.Intersection.CurveCurve(rarea,mLine1.ToNurbsCurve(),0,0)
        iSect2 = Rhino.Geometry.Intersect.Intersection.CurveCurve(rarea,mLine2.ToNurbsCurve(),0,0)
        
        for inte in iSect1:
            point1 = inte.PointA
            
        for inte in iSect2:
            point2 = inte.PointA
            
        #print (mLine1.Direction/mLine1.Length)
        
        #print point1
        #print point2
        
        deg = math.degrees(math.atan2(vec1.Y,vec1.X)-math.atan2(vec2.Y,vec2.X))
        #print deg
        
        #Vector3d.Unitize(
        vpointList = []
        for poin in rarea.Points:
            vect = Vector3d.Subtract(Vector3d(poin.Location),Vector3d(y))
            vect.Unitize()
            angle = math.degrees(math.atan2(vect.Y,vect.X)-math.atan2(vec1.Y,vec1.X))
            if angle >= 0 and angle <= 120:
                vpointList.append((vect,poin.Location))
        #print vpointList
        
        vpointList.sort(key = lambda x: math.degrees(math.atan2(x[0].Y,x[0].X)-math.atan2(vec1.Y,vec1.X)),reverse = True)
        
        #print vpointList
        pointList = []
        pointList.append(y)
        pointList.append(point2)
        for vpoint in vpointList:
            pointList.append(vpoint[1])
        pointList.append(point1)
        pointList.append(y)
        
        #print pointList
        
        
        #view = sc.doc.Views.ActiveView.ActiveViewport      
        #objectList = rh.RhinoDoc.ActiveDoc.Objects.FindByCrossingWindowRegion(view,pointList,True,rh.DocObjects.ObjectType.Curve)
        
        #sc.doc = rh.RhinoDoc.ActiveDoc
        #layerIndex = sc.doc.Layers.Find("ARS_DINDING",True)
        #sc.doc = ghdoc
        
        #oriWallList = [item for item in objectList if item.Attributes.LayerIndex == layerIndex]
                
        mLine2.To = point2
        mLine1.To = point1
        
        #Rhino.Geometry.Curve(
        
        viewArea = Polyline(pointList)
        viewAreaCurve = viewArea.ToPolylineCurve()
        
        #print viewArea.Item
        #for i in viewArea.GetSegments():
            #print i#.GetType()
        #print "begono"
        #print pointList
        m_wallList = [item.Geometry for item in objectList if item.Attributes.LayerIndex == layerIndex]
        iterInside = 0
        iterSect = 0
        outSide = 0
        iterTot = 0
        sect1 = 0
        sect2 = 0
        sect3 = 0
        sect25 = 0
        sect23 = 0
        upV = Vector3d(0,1,0)
        t3 = int(time.time()*1000000)
        print str((t3-t1))
        testPoint = Point3d.Add(y,vecDir)
        while len(m_wallList) > 0:
            ts1 = int(time.time()*1000000)
            #print "lenwa "+str(len(m_wallList))
            curWall = m_wallList.pop(0)
            #print curWall.GetType()
            iSect = Rhino.Geometry.Intersect.Intersection.CurveCurve(viewAreaCurve,curWall,0,0)
            pointToConsiderate = []
            for sect in iSect:
                iterSect+=1
                pointC,posPointC = viewAreaCurve.ClosestPoint(sect.PointA,0)
                pointW,posPointW = curWall.ClosestPoint(sect.PointA,0)
                #print "popor "+str(round(posPointW)) +" "+str(posPointW)
                closestIdx = round(posPointW) - posPointW
                if abs(closestIdx) > 0.05:
                    pointToConsiderate.append((sect.PointA,sect.PointA,posPointC,posPointW))
                    #print "sexey"
                    #print sect.PointA
            isPol,pointInCurve = curWall.TryGetPolyline()
            ts2 = int(time.time()*1000000)
            ts25 = ts27 = ts22 = ts23 = 0
            for p in pointInCurve:
                iterTot += 1
                ts25 = int(time.time()*1000000)
                
                #line = Line(p,upV,length)
                #iSect = Rhino.Geometry.Intersect.Intersection.CurveCurve(viewAreaCurve,line.ToNurbsCurve(),0,0)
                #if len(iSect) % 2 == 1:
                    #pointPos = Rhino.Geometry.PointContainment.Inside
                #else:
                    #pointPos = Rhino.Geometry.PointContainment.Outside
                ts22 = int(time.time()*1000000)
                vDir = Point3d.Subtract(p,y)
                #vDir.Unitize()
                #agl = abs(math.degrees(math.atan2(p.Y-y.Y, p.X-y.X) - math.atan2(testPoint.Y-y.Y, testPoint.X-y.X)))
                agl = math.degrees(Vector3d.VectorAngle(vDir,vecDir))
                ts23 = int(time.time()*1000000)
                sect23 += (ts23-ts22)
                if agl > 60:
                    continue
                pointPos = viewAreaCurve.Contains(p)
                
                #Polyline.ToPolylineCurve
                #pointPos = viewArea.ToPolylineCurve().Contains(p)
                #print pointPos
                ts27 = int(time.time()*1000000)
                sect25 += (ts27-ts25)
                #print "check "+str(p)+" "+str(pointPos)
                if pointPos == Rhino.Geometry.PointContainment.Inside:
                    iterInside += 1
                    line = Line(y,vDir,length)
                
                    iSect = Rhino.Geometry.Intersect.Intersection.CurveCurve(viewAreaCurve,line.ToNurbsCurve(),0,0)
                    
                    for sect in iSect:
                        if not sect.PointA.Equals(y):
                            pointC,posPointC = viewAreaCurve.ClosestPoint(sect.PointA,0)
                            pointW,posPointW = curWall.ClosestPoint(p,0)
                            #print "pero pero "+str(sect.PointA)+" "+str(pointC)+" "+str(posPoint)
                            pointToConsiderate.append((p,sect.PointA,posPointC,posPointW))
                elif pointPos == Rhino.Geometry.PointContainment.Coincident:
                    pointC,posPointC = viewAreaCurve.ClosestPoint(p,0)
                    pointW,posPointW = curWall.ClosestPoint(p,0)
                    pointToConsiderate.append((p,p,posPointC,posPointW))
                elif len(iSect) == 0:
                    outSide += 1
                    break
            ts3 = int(time.time()*1000000)
            #print "pomade"
            #print pointToConsiderate
            if len(pointToConsiderate) > 2:
                #print "splitt"
                pointToConsiderate.sort(key = lambda x: x[3])
                #print pointToConsiderate
                #pointToConsiderate.sort(key = lambda x: x[2])
                while len(pointToConsiderate) > 1:
                    curElm = pointToConsiderate.pop(0)
                    nextElm = pointToConsiderate[0]
                    newWall = Line(curElm[0],nextElm[0])
                    #print newWall
                    m_wallList.append(newWall.ToNurbsCurve())
                    
                    #at intersection
                    
                    e1 = nextElm[0]
                    e2 = nextElm[1]
                    
                    if e1.Equals(e2):
                        curElm = pointToConsiderate.pop(0)
                        
                    #different segment line
                    elif len(pointToConsiderate) > 1 and abs(int(pointToConsiderate[1][2]) - int(nextElm[2])) > 1:
                        curElm = pointToConsiderate.pop(0)
            elif len(pointToConsiderate) == 2:
                #print "foint"
                pointToConsiderate.sort(key = lambda x: x[2])
                #print pointToConsiderate
                #print len(pointToConsiderate)
                #print "inzana "+str(int(pointToConsiderate[0][2]+1))+" "+str(int(pointToConsiderate[1][2]+1))
                pointList.insert(int(pointToConsiderate[1][2]+1),pointToConsiderate[1][1])
                #print "p1"
                #print pointList
                if pointToConsiderate[1][0] != pointToConsiderate[1][1]:
                    pointList.insert(int(pointToConsiderate[1][2]+1),pointToConsiderate[1][0])
                    #print "p1.5"
                    #print pointList
                del pointList[int(pointToConsiderate[0][2]+1):int(pointToConsiderate[1][2]+1)]
                #print "p2"
                #print pointList
                if pointList[int(pointToConsiderate[0][2])] != pointToConsiderate[0][0]:
                    pointList.insert(int(pointToConsiderate[0][2]+1),pointToConsiderate[0][0])
                #print "p3"
                #print pointList
                if pointToConsiderate[0][0] != pointToConsiderate[0][1]:
                    pointList.insert(int(pointToConsiderate[0][2]+1),pointToConsiderate[0][1])
                    #print "p3.5"
                    #print pointList
                viewArea = Polyline(pointList)
                viewAreaCurve = viewArea.ToPolylineCurve()
                #wallList.append(curWall.Geometry)
            ts4 = int(time.time()*1000000)
            
            sect1 += (ts2-ts1)
            sect2 += (ts3-ts2)
            sect3 += (ts4-ts3)
            #print "iliterate"
            #print pointList
                
        #print"resta"
        #for po in pointList:
            #print po
        #TODO: check if only have 2 point, create new view field; if more split to several wall and continue the loop
        t2 = int(time.time()*1000000)
        print str((t2-t1))
        print iterTot
        print str(sect1)+" "+str(sect2)+" "+str(sect3)+" "+str(sect25)+" "+str(sect23)
        
        
        
        
        
        
        
        
        
        
        
        
        
        """wallList = []
        
        while len(oriWallList) > 0:
            curWall = oriWallList.pop()
            #Rhino.DocObjects.CurveObject.
            iSect = Rhino.Geometry.Intersect.Intersection.CurveCurve(viewAreaCurve,curWall.Geometry,0,0)
            print curWall.Id
            #for sect in iSect:
                #print sect.PointA
                #print sect.PointB
            #print len(iSect)
            pointToConsiderate = []
            
            #intersection point
            for sect in iSect:
                pointC,posPoint = curWall.Geometry.ClosestPoint(sect.PointA,0)
                pointToConsiderate.append((sect.PointA,sect.PointA,posPoint))
                
            print "intersection point"
            for pot in pointToConsiderate:
                print pot[0]
                
            #viewAreaCurve = viewArea.ToNurbsCurve()
            #print "zzzzzzzzzzzzzzzzzzzzzz"
            #arpo = viewArea.ToArray()
            #for aa in arpo:
                #p,f = viewAreaCurve.ClosestPoint(aa,0)
                #print str(aa)+" "+str(p)+" "+str(f)
            #print "hhhhhhhhhhhhhhhhh"
            #for i in range(0,len(arpo)):
                #plo = viewAreaCurve.PointAt(i)
                #print str(i)+" "+str(plo)
                
            #print "eeeeeeeeeeeeeeeeeeeee"
            
            #point in wall inside view area + projection into view area
            #Rhino.Geometry.Curve.Contains(
            isPol,pointInCurve = curWall.Geometry.TryGetPolyline()
            #pointInCurve = pointInCurve[:-1]
            
            print "curve point"
            for po in pointInCurve:
                print po
            
            #pointInside = [p for p in pointInCurve if viewArea.Contains(p) == Rhino.Geometry.PointContainment.Inside]
            pointInside = []
            #print viewArea.GetType()
            #Rhino.Geometry.NurbsCurve.Contains(
            for p in pointInCurve:
                pointPos = viewAreaCurve.Contains(p)
                #print "check "+str(p)+" "+str(pointPos)
                if pointPos == Rhino.Geometry.PointContainment.Inside:
                    vDir = Point3d.Subtract(p,y)
                    vDir.Unitize()
                    line = Line(y,vDir,length)
                
                    iSect = Rhino.Geometry.Intersect.Intersection.CurveCurve(viewAreaCurve,line.ToNurbsCurve(),0,0)
                    
                    for sect in iSect:
                        if not sect.PointA.Equals(y):
                            pointC,posPoint = curWall.Geometry.ClosestPoint(sect.PointA,0)
                            pointToConsiderate.append((p,sect.PointA,posPoint))
                            print "apenying "+str(sect.PointA)
                    
            if len(pointToConsiderate) > 2:
                print len(pointToConsiderate)
                pointToConsiderate.sort(key = lambda x: x[2])
                while len(pointToConsiderate) > 1:
                    curElm = pointToConsiderate.pop()
                    nextElm = pointToConsiderate[0]
                    newWall = Line(curElm[0],nextElm[0])
                    print newWall
                    wallList.append(newWall.ToNurbsCurve())
                    
                    #at intersection
                    
                    e1 = nextElm[0]
                    e2 = nextElm[1]
                    
                    if e1.Equals(e2):
                        curElm = pointToConsiderate.pop()
                        
                    #different segment line
                    elif len(pointToConsiderate) > 1 and abs(int(pointToConsiderate[1][2]) - int(nextElm[2])) > 1:
                        curElm = pointToConsiderate.pop()
            else:
                wallList.append(curWall.Geometry)
            #Rhino.Geometry.Curve.ClosestPoint(
            #pointToConsiderate.extend(pointInside)
            
            #projection of point inside curve
            #for p in pointInside:
                #vDir = Point3d.Subtract(p,y)
                #vDir.Unitize()
                #line = Line(y,vDir,length)
                
                #iSect = Rhino.Geometry.Intersect.Intersection.CurveCurve(viewArea.ToNurbsCurve(),line.ToNurbsCurve(),0,0)
                #for sect in iSect:
                   # pointToConsiderate.append(sect.PointA)
                
            
            
            
            #for p in pointToConsiderate:
                #print p
                
             
        
        
        
        #for wall in wallList:
            #print wall.Geometry.GetType()
            #Rhino.DocObjects.CurveObject.Geometry
            #iSect = Rhino.Geometry.Intersect.Intersection.CurveCurve(wall.Geometry,mLine2.ToNurbsCurve(),0,0)
            #for inte in iSect:
                
        
        
            #vect = vect/vect.Length
        #Rhino.Geometry.Intersect.IntersectionEvent.PointA
        
        #Rhino.Geometry.Intersect.CurveIntersections.Item
        #Rhino.Geometry.Line(
        #print iSect
        print "mmmmmmmmmmmmmmmm"
        for weol in wallList:
            print weol
        print "ccccccccccccccccc"
        self.pola = viewArea
        
        #Rhino.Geometry.NurbsCurve.ClosestPoint(
        
        #view = sc.doc.Views.ActiveView.ActiveViewport      
        #objectList = rh.RhinoDoc.ActiveDoc.Objects.FindByCrossingWindowRegion(view,pl,True,rh.DocObjects.ObjectType.Curve)
        #Vector3d.Rotate(
        #print objectList
        #for oi in objectList:
            #rg.Intersect.Intersection.CurveCurve(
            #rs.CurveCurveIntersection
            #print oi.Id
            #rs.CurveCurveIntersection(
            #iter = []
            #iter = rs.CurveCurveIntersection(oi.CurveGeometry,x,0)
            #p = []
            #iter(p)
            #if not iter:
                #continue
            #print iter
            #print p
            #for aa in iter:
                #print aa
            #print "bbbbbbbbbbb"
        # return outputs if you have them; here I try it for you:
            """
        return self.pola
# ---------- end python_2 ----------
c_script = CSharpScript(x=rec, y=pt)  # -> out, A; inputs x: Rectangle3d, y: Point3d
# ---------- c_script: C# usings ----------
using Rhino.DocObjects;
using System.Linq;
# ---------- c_script: C# ----------
    //Rhino.RhinoDoc.ActiveDoc.Views.ActiveView
    Polyline pl = x.ToPolyline();
    Layer wallLayer = RhinoDoc.ActiveDoc.Layers.FindName("ARS_DINDING");
    List<Rhino.DocObjects.RhinoObject> wallList = Rhino.RhinoDoc.ActiveDoc.Objects.FindByCrossingWindowRegion(Rhino.RhinoDoc.ActiveDoc.Views.ActiveView.ActiveViewport, pl, true, Rhino.DocObjects.ObjectType.Curve).Where(elm => elm.Attributes.LayerIndex == 98).ToList();
    Print("ddo " + ((Rhino.DocObjects.CurveObject) wallList.ElementAt(0)).CurveGeometry.GetType());
    Rhino.DocObjects.RhinoObject j;
    List<Rhino.Geometry.Curve> wallListCurve = new List<Rhino.Geometry.Curve>();
    for(int i = wallList.Count() - 1;i >= 0;i--)
    {
      wallListCurve.Insert(0, ((Rhino.DocObjects.CurveObject) wallList.ElementAt(i)).CurveGeometry);
    }

    //ro.
    //RhinoObject r;
    //r.
    DateTime t1 = DateTime.Now;
    Vector3d unitDir = new Vector3d(0, 1, 0);
    Vector3d myDir = new Vector3d(unitDir);
    //myDir.Rotate(RhinoMath.ToRadians(-90), Vector3d.ZAxis);
    Print("hombara " + pl.ElementAt(0));
    var diagL = Point3d.Subtract(pl.ElementAt(0), pl.ElementAt(2)).Length;
    Print("whale " + wallLayer + " " + wallList.Count() + " " + diagL);

    Vector3d tmp = new Vector3d(myDir);
    tmp.Rotate(RhinoMath.ToRadians(-60), Vector3d.ZAxis);
    Line l1 = new Line(y, tmp, diagL);

    tmp.Rotate(RhinoMath.ToRadians(120), Vector3d.ZAxis);
    Line l2 = new Line(y, tmp, diagL);

    tmp.Rotate(RhinoMath.ToRadians(-120), Vector3d.ZAxis);

    var iSect = Rhino.Geometry.Intersect.Intersection.CurveCurve(pl.ToPolylineCurve(), l1.ToNurbsCurve(), 0, 0);
    Point3d point1 = new Point3d(0, 0, 0);
    for(int i = 0;i < iSect.Count;i++)
    {
      point1 = iSect.ElementAt(i).PointA;
      Print("puki " + point1);
    }
    //Print("puki " + point1);
    iSect = Rhino.Geometry.Intersect.Intersection.CurveCurve(pl.ToPolylineCurve(), l2.ToNurbsCurve(), 0, 0);
    Point3d point2 = new Point3d(0, 0, 0);
    for(int i = 0;i < iSect.Count;i++)
    {
      point2 = iSect.ElementAt(i).PointA;
    }

    List<Point3d> pointList = new List<Point3d>();
    List<Tuple<Point3d,double>> vpointList = new List<Tuple<Point3d,double>>();
    for(int i = 0;i < pl.Count - 1;i++)
    {
      Vector3d dir = Point3d.Subtract(pl.ElementAt(i), y);
      dir.Unitize();
      double angle = RhinoMath.ToDegrees(Math.Atan2(dir.Y, dir.X) - Math.Atan2(tmp.Y, tmp.X));
      //Print("elus " + angle);
      if(angle >= 0 && angle <= 120)
      {
        vpointList.Add(Tuple.Create(pl.ElementAt(i), angle));
      }
      //pointList
    }
    Tuple<int,int> cc = Tuple.Create(3, 4);
    //Print("fff " + cc.Item1);
    vpointList = vpointList.OrderByDescending(elm => elm.Item2).ToList();
    pointList.Add(y);
    pointList.Add(point2);
    for(int i = 0;i < vpointList.Count();i++)
    {
      pointList.Add(vpointList.ElementAt(i).Item1);
    }
    pointList.Add(point1);
    pointList.Add(y);

    Polyline viewArea = new Polyline(pointList);
    PolylineCurve viewAreaCurve = viewArea.ToPolylineCurve();

    List<Rhino.Geometry.Curve> checkWallList = new List<Rhino.Geometry.Curve>(wallListCurve);
    List<Tuple<Point3d,Point3d,double,double>> pointToConsiderate = new List<Tuple<Point3d,Point3d,double,double>>();

    Vector3d vDir = new Vector3d(tmp);
    Tuple<Point3d,Point3d,double,double> tmpTuple;
    while(checkWallList.Count() > 0)
    {
      Rhino.Geometry.Curve curWall = checkWallList.ElementAt(0);
      checkWallList.RemoveAt(0);
      iSect = Rhino.Geometry.Intersect.Intersection.CurveCurve(viewAreaCurve, curWall, 0, 0);

      pointToConsiderate.Clear();
      foreach (Rhino.Geometry.Intersect.IntersectionEvent sect in iSect)
      {
        double posPointC;
        viewAreaCurve.ClosestPoint(sect.PointA, out posPointC);
        double posPointW;
        curWall.ClosestPoint(sect.PointA, out posPointW);
        double testPos = Math.Round(posPointW) - posPointW;
        if(Math.Abs(testPos) > 0.05)
        {
          pointToConsiderate.Add(Tuple.Create(sect.PointA, sect.PointA, posPointC, posPointW));
        }
      }
      Polyline pll;
      curWall.TryGetPolyline(out pll);

      foreach(Point3d p in pll)
      {
        vDir = Point3d.Subtract(p, y);
        double angle = RhinoMath.ToDegrees(Vector3d.VectorAngle(vDir, myDir));
        if(angle > 60)
        {
          continue;
        }
        Rhino.Geometry.PointContainment pointPos = viewAreaCurve.Contains(p);
        //Print("peplos " + pointPos);
        if(pointPos == Rhino.Geometry.PointContainment.Inside)
        {
          Line line = new Line(y, vDir, diagL);
          iSect = Rhino.Geometry.Intersect.Intersection.CurveCurve(viewAreaCurve, line.ToNurbsCurve(), 0, 0);
          foreach (Rhino.Geometry.Intersect.IntersectionEvent sect in iSect)
          {
            if(!sect.PointA.Equals(y))
            {
              double posPointC;
              viewAreaCurve.ClosestPoint(sect.PointA, out posPointC);
              double posPointW;
              curWall.ClosestPoint(p, out posPointW);
              //Print("penpendar ");
              pointToConsiderate.Add(Tuple.Create(p, sect.PointA, posPointC, posPointW));
              //Print("perotak "+pointToConsiderate.Count());
            }
          }
        }
        else if(pointPos == Rhino.Geometry.PointContainment.Coincident)
        {
          double posPointC;
          viewAreaCurve.ClosestPoint(p, out posPointC);
          double posPointW;
          curWall.ClosestPoint(p, out posPointW);
          pointToConsiderate.Add(Tuple.Create(p, p, posPointC, posPointW));
        }
        else if(iSect.Count == 0)
        {
          break;
        }
      }
      //Print("samkara " + pointToConsiderate.Count());
      if(pointToConsiderate.Count > 2)
      {
        pointToConsiderate = pointToConsiderate.OrderBy(elm => elm.Item4).ToList();
        //Print();
        while(pointToConsiderate.Count() > 1)
        {
          var curElm = pointToConsiderate.ElementAt(0);
          pointToConsiderate.RemoveAt(0);
          //Print("remkaliii");
          var nextElm = pointToConsiderate.ElementAt(0);
          Line newWall = new Line(curElm.Item1, nextElm.Item1);
          checkWallList.Add(newWall.ToNurbsCurve());
          if(nextElm.Item1.Equals(nextElm.Item2))
          {
            pointToConsiderate.RemoveAt(0);
          }
          else if(pointToConsiderate.Count > 1 && Math.Abs(((int) pointToConsiderate.ElementAt(1).Item3) - ((int) nextElm.Item3)) > 1)
          {
            pointToConsiderate.RemoveAt(0);
          }
        }
      }
      else if(pointToConsiderate.Count == 2)
      {
        pointToConsiderate = pointToConsiderate.OrderBy(elm => elm.Item3).ToList();
        tmpTuple = pointToConsiderate.ElementAt(1);
        pointList.Insert((int) (tmpTuple.Item3 + 1), tmpTuple.Item2);
        if(!tmpTuple.Item1.Equals(tmpTuple.Item2))
        {
          pointList.Insert((int) (tmpTuple.Item3 + 1), tmpTuple.Item1);
        }
        int idxToRemove = (int) (tmpTuple.Item3);
        tmpTuple = pointToConsiderate.ElementAt(0);
        pointList.RemoveRange((int) (tmpTuple.Item3 + 1), idxToRemove - (int) (tmpTuple.Item3));
        if(!pointList.ElementAt((int) tmpTuple.Item3).Equals(tmpTuple.Item1))
        {
          pointList.Insert((int) (tmpTuple.Item3 + 1), tmpTuple.Item1);
        }
        if(!tmpTuple.Item1.Equals(tmpTuple.Item2))
        {
          pointList.Insert((int) (tmpTuple.Item3 + 1), tmpTuple.Item2);
        }
        viewArea = new Polyline(pointList);
        viewAreaCurve = viewArea.ToPolylineCurve();
      }
      //Print("sekot " + iSect.Count);
    }

    DateTime t2 = DateTime.Now;
    TimeSpan ts = t2 - t1;
    Print("tossua " + ts.TotalMilliseconds);
    //foreach(Point3d pph in pointList)
    //{
    //Print("polit " + pph);
    //}
    //Print("cudat "+DateTime.UtcNow);
    //pointList.
    //ro.
    //RhinoObject[] allWall = Rhino.RhinoDoc.ActiveDoc.Objects.FindByLayer("ARS-DINDING");
    //Rhino.RhinoApp.WriteLine("asu");
    //Print("kampret");
    //for(int i = 0;i < ro.Length;i++)
    //for(int i = 0;i < ro.Count();i++)
    //{
    //Rhino.RhinoApp.WriteLine("ojek " + ro[i]);
    //Console.WriteLine("ojek " + ro[i]);
    //Print("ojek " + ro[i].Id+" "+ro[i].Attributes.LayerIndex);
    //Print("ojek " + ro.ElementAt(i).Id);
    //}
# ---------- end c_script ----------
panel = Panel(c_script.out)
