# Grasshopper definition unit-door.ghx (Grasshopper 1.0.7)

rec = Rectangle({Plane=PlaneXY(3.824016141, 12.03936067, 0), Size=Domain2(u=-1.014886859..1.014886859, v=-4.742461957..4.742461957)})
python = GhPythonScript(x=rec)  # -> a
# ---------- python: Python ----------
from ghpythonlib.componentbase import executingcomponent as component
import Grasshopper, GhPython
import System
import Rhino as rh
import rhinoscriptsyntax as rs
import scriptcontext as sc
import sys
from Rhino.Geometry import Point3d,Vector3d
import Rhino.DocObjects
import math

cFPath = ghenv.Component.OnPingDocument().FilePath
cpath = cFPath[0:cFPath.rfind('\\')+1]
my_path = cpath+'..\source'
if not my_path in sys.path:
    sys.path.append(my_path)

import Door
Door = reload(Door)
DIRECTION_CCW = -1
DIRECTION_CW = 1
OFFSET = 0.01
class MyComponent(component):
    
    def RunScript(self,x):
        """Provides a scripting component.
            Inputs:
                x: The x script variable
                y: The y script variable
            Output:
                a: The a output variable"""
        
        __author__ = "remote"
        __version__ = "2020.12.18"
        sc.doc = ghdoc
        import rhinoscriptsyntax as rs
        print x
        rectArea = rs.coercecurve(x)
        print rectArea
        rc,pl = rectArea.TryGetPolyline()
        #print rc
        #print pl
        view = sc.doc.Views.ActiveView.ActiveViewport
        objectList = rh.RhinoDoc.ActiveDoc.Objects.FindByCrossingWindowRegion(view,pl,True,rh.DocObjects.ObjectType.AnyObject)
        doorObject = []
        doorGroup = []
        
        doorPanelGroup = []
        doorPanelObject = []
        doorFrameGroup = []
        doorFrameObject = []
        #rh.Geometry.BoundingBox.Union.
        for oo in objectList:
            #print oo.Id
            #print rs.GetUserText(oo,"Type")
            if rs.GetUserText(oo,"Type") == "Door":
                groupList = oo.GetGroupList()
                print rs.GetUserText(oo,"Part")
                part = rs.GetUserText(oo,"Part")
                
                if part == "Panel":
                    doorPanelObject.append(oo)
                    for group in groupList:
                        doorPanelGroup.append(group)
                else:
                    found = False
                    index = -1
                    for group in groupList:
                        for (idx,existGroup) in enumerate(doorFrameGroup):
                            for singleGroup in existGroup:
                                if group == singleGroup:
                                    found = True
                                    index = idx
                                    break
                    if not found:
                        doorFrameGroup.append(groupList)
                        doorFrameObject.append([oo])
                    else:
                        doorFrameObject[index].append(oo)
            
        tesObj = None
        for oi in doorPanelObject:
            print oi.GetType()
            print oi.Id
            tesObj = oi
        
        print "frame"
        for ou in doorFrameObject:
            for kk in ou:
               print kk.Id
        pClone = None
        #rh.Geometry.InstanceReferenceGeometry.GetBoundingBox(
        #rh.Geometry.BoundingBox.Center
        for (doorGroup,panelObj) in zip(doorPanelGroup,doorPanelObject):
            index = -1
            for (idx,frameGroups) in enumerate(doorFrameGroup):
                for group in frameGroups:
                    if doorGroup == group:
                        index = idx
                        break
                if index != -1:
                    break
            if index != -1:
                print panelObj.GetType()
                pClone = panelObj.DuplicateGeometry()
                print pClone.GetType()
                frameBoundingBox = rh.Geometry.BoundingBox.Union(doorFrameObject[index][0].Geometry.GetBoundingBox(True),doorFrameObject[index][1].Geometry.GetBoundingBox(True))
                rotCenter, rotDir = self.DetermineRotationCenterAndDir(frameBoundingBox,panelObj)
                doorObject.append(Door.Door(panelObj,frameBoundingBox,rotCenter,rotDir,Door.DOOR_OPEN))
        for do in doorObject:
            do.Close()
        # return outputs if you have them; here I try it for you:
        #rs.AddPoints(
        #pClone.Translate(1.0,0.0,0.0)
        #listClone = []
        #listClone.append(pClone)
        #listCenter = []
        #rh.DocObjects.InstanceObject.InstanceDefinition.Index
        #rh.Geometry.InstanceReferenceGeometry.Xform
        #corona = tesObj.Geometry.GetBoundingBox(True).GetCorners()
        #print "ago"
        #print corona
        #print "bego"
        #print tesObj.Geometry.GetBoundingBox(True).Center
        #tesObj.Geometry.Translate(1.0,0.0,0.0)
        #centerRotation = tesObj.Geometry.GetBoundingBox(True).GetCorners()[3]
        #print centerRotation
        #centerRotation.X += 0.01
        #print "lembu"
        #print centerRotation
        #sc.doc = rh.RhinoDoc.ActiveDoc
        #tesObj.Geometry.Rotate(math.radians(90),Vector3d.ZAxis,centerRotation) 
        #goo = tesObj.CommitChanges()
        #sc.doc = ghdoc
        #print goo
        #rh.DocObjects.InstanceObject.Id,centerRotation,90)
        #print tesObj.Geometry.GetBoundingBox(True).Center
        #print tesObj.InstanceDefinition.Index
        #print tesObj.Geometry.Xform
        #print tesObj.Id
        #rs.RotateObject(
        #cero = rs.coerce3dpoint(centerRotation,True)
        #axu = rs.coerce3dvector(Vector3d.ZAxis,True)
        #xf = rh.Geometry.Transform.Rotation(math.radians(90), axu, cero)
        #print cero
        #print axu
        #print xf
        #tok = rs.RotateObject(tesObj,centerRotation,90,Vector3d.ZAxis)
        #print tok
        #sc.doc = ghdoc
        #gai = rh.RhinoDoc.ActiveDoc.Objects.AddInstanceObject(tesObj.InstanceDefinition.Index,tesObj.Geometry.Xform)
        #print gai
        #rh.RhinoDoc.ActiveDoc.Objects.AddPoint(pClone.GetBoundingBox(True).Center)
        #rh.RhinoDoc.ActiveDoc.Objects.AddRhinoObject(
        #rs.AddPoint(pClone.GetBoundingBox(True).Center)
        #return pClone.GetBoundingBox(True).Center
        return None#listClone#.GetBoundingBox(True).Center

    def DetermineRotationCenterAndDir(self, frameBox, panel):
        panelBox = panel.Geometry.GetBoundingBox(True)
        panelCenter = panelBox.Center
        
        frameCenter = frameBox.Center
        
        panelCorner = panelBox.GetCorners()
        isPanelVertical = (panelCorner[2].X - panelCorner[0].X < panelCorner[2].Y - panelCorner[0].Y)
        index = 0
        direction = DIRECTION_CCW
        if isPanelVertical:
            if frameCenter.X > panelCenter.X:
                if frameCenter.Y > panelCenter.Y:
                    index = 3
                else:
                    index = 0
                    direction = DIRECTION_CW
            else:
                if frameCenter.Y > panelCenter.Y:
                    index = 2
                    direction = DIRECTION_CW
                else:
                    index = 1
        else:
            if frameCenter.X > panelCenter.X:
                if frameCenter.Y > panelCenter.Y:
                    index = 1
                    direction = DIRECTION_CW
                else:
                    index = 2
            else:
                if frameCenter.Y > panelCenter.Y:
                    index = 0
                else:
                    index = 3
                    direction = DIRECTION_CW
        rotationCenter = panelCorner[index]
        
        if isPanelVertical:
            if index == 0 or index == 3:
                rotationCenter.X += OFFSET
            else:
                rotationCenter.X -= OFFSET
        else:
            if index == 0 or index == 1:
                rotationCenter.Y += OFFSET
            else:
                rotationCenter.Y -= OFFSET
        return rotationCenter, direction
# ---------- end python ----------
geo = Geometry(python)
